# Dynamo graph Autodesk-MaRS-office-example-v3.dyn (Dynamo 2.12.0.5650)
# packages: SpaceAnalysis 0.3.3, Dynamo Text 2.0.1, Solar Analysis for Dynamo 1.10.0

# note: Variables / Inputs
# Variables that can be altered per project and must be set accordingly before running the script.

# group: MaRS with All Metrics
# note: DYNAMO PROJECT
# Autodesk-MaRS-office-example-Solar-daylighting-v2.dyn
# note: ASSOCIATED FILE(S)
# N/A
# note: AUTHOR(S) / CREATION DATE
# Autodesk Systems Group / 2019
# note: DESCRIPTION
# Example project description.
# note: DYNAMO VERSION
# 2.0.2, 2.1.0, 2.2.0, 2.2.1, 2.3.0
# note: ADDITIONAL COMMENTS
# N/A
# note: REQUIRED DYNAMO PACKAGES
# SpaceAnalysis 0.2.3+
# Solar Analysis for Dyanamo
# DynamoText

# group: Create Outer Boundary
# note: Creates outer walls and windows. This remains static for each design. While this is done statically, this can also be imported from Revit and cached with a Remember node or loaded as a SAT file. We did it this way to keep the example more self-contained.
code_block = CodeBlock()
# ---------- code_block.designscript (4 lines) ----------
[3.85,-18.938,35.211,-18.849,35.022,-35.469,31.766,-35.444,31.724,-43.581,35.218,-43.540,35.090,-54.469,18.302,-54.327,18.198,-65.545,21.221,-65.617,21.225,-72.260,16.282,-72.256,16.248,-89.297,35.143,-89.374,35.340,-104.360,3.664,-104.349,3.690,-43.758,14.197,-43.638,14.161,-35.455,3.85,-35.482];
2;
-1;
-2;
# ----------------------------------------
takeEveryNthItem = List.TakeEveryNthItem(list=code_block.out0, n=code_block.out1, offset=code_block.out2)
takeEveryNthItem_2 = List.TakeEveryNthItem(list=code_block.out0, n=code_block.out1, offset=code_block.out3)
byCoordinates = Point.ByCoordinates(x=takeEveryNthItem, y=takeEveryNthItem_2)
code_block_2 = CodeBlock(boundaryPoints=byCoordinates) { boundaryPoints; }
code_block_3 = CodeBlock(boundaryPoints=code_block_2) { boundaryPoints; }
code_block_4 = CodeBlock { 1; }
dropItems = List.DropItems(list=code_block_2, amount=code_block_4)
firstItem = List.FirstItem(list=code_block_2)
join = List.Join(list0=dropItems, list1=firstItem)
byStartPointEndPoint = Line.ByStartPointEndPoint(startPoint=byCoordinates, endPoint=join)
code_block_5 = CodeBlock { [0,1,2,3,4,5,14,15,16,17,18,19]; }
getItemAtIndex = List.GetItemAtIndex(list=byStartPointEndPoint, index=code_block_5)
code_block_6 = CodeBlock { 7; }
extrude = Curve.Extrude(curve=getItemAtIndex, distance=code_block_6)
code_block_7 = CodeBlock(windowsAsSurfaces=extrude) { windowsAsSurfaces; }
code_block_8 = CodeBlock(boundaryAsLines=byStartPointEndPoint) { boundaryAsLines; }
byJoinedCurves = PolyCurve.ByJoinedCurves(curves=byStartPointEndPoint)
byPatch = Surface.ByPatch(closedCurve=byJoinedCurves)
code_block_9 = CodeBlock(boundaryAsSuface=byPatch) { boundaryAsSuface; }
code_block_10 = CodeBlock(windowsAsLines=getItemAtIndex) { windowsAsLines; }
code_block_11 = CodeBlock { 2; }
code_block_12 = CodeBlock(curve=getItemAtIndex, segLength=code_block_11) { segments = Math.Max(2, Math.Floor((Autodesk.Curve.Length(curve)) / segLength)); seq = (0..1..#segments); }
pointAtParameter = Curve.PointAtParameter(curve=getItemAtIndex, param=code_block_12.seq)
code_block_13 = CodeBlock(windowPoints=pointAtParameter) { windowPoints; }
code_block_14 = CodeBlock { [6, 7, 8, 9, 10, 11, 12, 13]; }
getItemAtIndex_2 = List.GetItemAtIndex(list=byStartPointEndPoint, index=code_block_14)
code_block_15 = CodeBlock { 7; }
extrude_2 = Curve.Extrude(curve=getItemAtIndex_2, distance=code_block_15)
# note: Walls and windows are returned in  various formats, as as surfaces, lines, or point samples.
code_block_16 = CodeBlock(wallsAsSurfaces=extrude_2) { wallsAsSurfaces; }

# group: Create GD Regions
# note: Creating regions where Generative Design will actually take place: in this case it's two regions, a rectangle and an L shape. The algorithm assumes that this shape can have a spine defined through it.
code_block_17 = CodeBlock(boundaryPoints=code_block_3) { boundaryPoints; }
code_block_18 = CodeBlock { [0,1,2,19]; [14,15,16]; }
getItemAtIndex_3 = List.GetItemAtIndex(list=code_block_17, index=code_block_18.out0)
byPoints = Polygon.ByPoints(points=getItemAtIndex_3)
getItemAtIndex_4 = List.GetItemAtIndex(list=code_block_17, index=code_block_18.out1)
number_slider = DoubleSlider(14.082, range=0..100 step 0.1)
number_slider_2 = DoubleSlider(-43.638, range=-44.284..100 step 0.1)
byCoordinates_2 = Point.ByCoordinates(x=number_slider, y=number_slider_2)
number_slider_3 = DoubleSlider(14.014, range=0..100 step 0.1)
number_slider_4 = DoubleSlider(-91.124, range=-92.616..100 step 0.1)
byCoordinates_3 = Point.ByCoordinates(x=number_slider_3, y=number_slider_4)
number_slider_5 = DoubleSlider(35.159, range=0..100 step 0.1)
number_slider_6 = DoubleSlider(-91.158, range=-91.158..100 step 0.1)
byCoordinates_4 = Point.ByCoordinates(x=number_slider_5, y=number_slider_6)
join_2 = List.Join(list0=getItemAtIndex_4, list1=byCoordinates_2, list2=byCoordinates_3, list3=byCoordinates_4)
byPoints_2 = Polygon.ByPoints(points=join_2)
list_create = List.Create(item0=byPoints, item1=byPoints_2)
code_block_19 = CodeBlock(gdRegions=list_create) { gdRegions; }

# group: Create Region Spines
# note: Spines are manually defined Lines/Curves, and remain static for each Refinery run.
# NOTE: if you want to edit the spines, you can turn on Preview for Points and drag them in interactive mode.
number_slider_7 = DoubleSlider(3.846, range=0..100 step 0.1)
number_slider_8 = DoubleSlider(-27.226, range=-28.078..100 step 0.1)
byCoordinates_5 = Point.ByCoordinates(x=number_slider_7, y=number_slider_8)
number_slider_9 = DoubleSlider(35.106, range=0..100 step 0.1)
number_slider_10 = DoubleSlider(-27.226, range=-28.078..100 step 0.1)
byCoordinates_6 = Point.ByCoordinates(x=number_slider_9, y=number_slider_10)
byStartPointEndPoint_2 = Line.ByStartPointEndPoint(startPoint=byCoordinates_5, endPoint=byCoordinates_6)
number_slider_11 = DoubleSlider(8.989, range=0..100 step 0.1)
number_slider_12 = DoubleSlider(-43.64, range=-43.833..100 step 0.1)
byCoordinates_7 = Point.ByCoordinates(x=number_slider_11, y=number_slider_12)
number_slider_13 = DoubleSlider(8.757, range=0..100 step 0.1)
number_slider_14 = DoubleSlider(-98.015, range=-98.104..100 step 0.1)
byCoordinates_8 = Point.ByCoordinates(x=number_slider_13, y=number_slider_14)
number_slider_15 = DoubleSlider(35.171, range=0..100 step 0.1)
number_slider_16 = DoubleSlider(-97.874, range=-97.874..100 step 0.1)
byCoordinates_9 = Point.ByCoordinates(x=number_slider_15, y=number_slider_16)
list_create_2 = List.Create(item0=byCoordinates_7, item1=byCoordinates_8, item2=byCoordinates_9)
byPoints_3 = PolyCurve.ByPoints(points=list_create_2)
list_create_3 = List.Create(item0=byStartPointEndPoint_2, item1=byPoints_3)
code_block_20 = CodeBlock(spineCurves=list_create_3) { spineCurves; }

# group: Inputs
# note: Working / Functions
# Core working of the script.
# note: "spine" parameters move neighborhood centers along neighborhood spines
nbr1_spine = DoubleSlider(0.4, range=-0.4..0.4 step 0.1)  # graph input
nbr2_spine = DoubleSlider(0.3, range=-0.4..0.4 step 0.1)  # graph input
list_create_4 = List.Create(item0=nbr1_spine, item1=nbr2_spine)
# note: Display / Visualization
# Logic used simply for visualization purposes, and doesn't contain core logic.
nbr3_spine = DoubleSlider(0.4, range=-0.4..0.4 step 0.1)  # graph input
nbr4_spine = DoubleSlider(0.3, range=-0.4..0.4 step 0.1)  # graph input
# note: Metrics / Goals / Outputs
# Logic associated with calculating goals, metrics, outputs .
nbr5_spine = DoubleSlider(0, range=-0.4..0.4 step 0.1)  # graph input
nbr6_spine = DoubleSlider(0.1, range=-0.4..0.4 step 0.1)  # graph input
nbr7_spine = DoubleSlider(-0.4, range=-0.4..0.4 step 0.1)  # graph input
nbr8_spine = DoubleSlider(-0.3, range=-0.4..0.4 step 0.1)  # graph input
list_create_5 = List.Create(item0=nbr3_spine, item1=nbr4_spine, item2=nbr5_spine, item3=nbr6_spine, item4=nbr7_spine, item5=nbr8_spine)
list_create_6 = List.Create(item0=list_create_4, item1=list_create_5)
# note: "perp spine" parameters move neighborhood centers perpendicular to neighborhood spines
nbr1_perp_spine = DoubleSlider(-0.1, range=-0.4..0.4 step 0.1)  # graph input
nbr2_perp_spine = DoubleSlider(-0.1, range=-0.4..0.4 step 0.1)  # graph input
list_create_7 = List.Create(item0=nbr1_perp_spine, item1=nbr2_perp_spine)
nbr3_perp_spine = DoubleSlider(-0.3, range=-0.4..0.4 step 0.1)  # graph input
nbr4_perp_spine = DoubleSlider(0, range=-0.4..0.4 step 0.1)  # graph input
nbr5_perp_spine = DoubleSlider(0.2, range=-0.4..0.4 step 0.1)  # graph input
nbr6_perp_spine = DoubleSlider(0.2, range=-0.4..0.4 step 0.1)  # graph input
nbr7_perp_spine = DoubleSlider(-0.1, range=-0.4..0.4 step 0.1)  # graph input
nbr8_perp_spine = DoubleSlider(-0.1, range=-0.4..0.4 step 0.1)  # graph input
list_create_8 = List.Create(item0=nbr3_perp_spine, item1=nbr4_perp_spine, item2=nbr5_perp_spine, item3=nbr6_perp_spine, item4=nbr7_perp_spine, item5=nbr8_perp_spine)
list_create_9 = List.Create(item0=list_create_7, item1=list_create_8)
# note: "am side" parameters change which neighborhood edge will be used to create amenity space
nbr1_am_side = DoubleSlider(0.7, range=0..1 step 0.1)  # graph input
nbr2_am_side = DoubleSlider(0.6, range=0..1 step 0.1)  # graph input
nbr3_am_side = DoubleSlider(0.5, range=0..1 step 0.1)  # graph input
nbr4_am_side = DoubleSlider(0.8, range=0..1 step 0.1)  # graph input
nbr5_am_side = DoubleSlider(0.5, range=0..1 step 0.1)  # graph input
nbr6_am_side = DoubleSlider(0.4, range=0..1 step 0.1)  # graph input
nbr7_am_side = DoubleSlider(0.5, range=0..1 step 0.1)  # graph input
nbr8_am_side = DoubleSlider(0, range=0..1 step 0.1)  # graph input
list_create_10 = List.Create(item0=nbr1_am_side, item1=nbr2_am_side, item2=nbr3_am_side, item3=nbr4_am_side, item4=nbr5_am_side, item5=nbr6_am_side, item6=nbr7_am_side, item7=nbr8_am_side)

# group: Find Neighborhood Center Points
code_block_21 = CodeBlock(spineCurves=code_block_20) { spineCurves; }
code_block_22 = CodeBlock { neighborhoodSizes = [2,6]; }
# note: Create an offset neighborhood centers based on input parameters, these new centers will be used to seed Voronoi algarithm, which will produce neightborhood boundaries.
code_block_23 = CodeBlock(parameterAdjustAlongSpine=list_create_6) { parameterAdjustAlongSpine; }
code_block_24 = CodeBlock(n=code_block_22, adjust=code_block_23) { initial = ((1/(n*2))..(1-(1/(n*2)))..#n); i = initial + (adjust  * (1/(n*2))); }
pointAtParameter_2 = Curve.PointAtParameter(curve=code_block_21, param=code_block_24.i)
normalAtParameter = Curve.NormalAtParameter(curve=code_block_21, param=code_block_24.i)
code_block_25 = CodeBlock(parameterAdjustPerpindicularToSpine=list_create_9) { parameterAdjustPerpindicularToSpine; }
code_block_26 = CodeBlock { regionThickness = [6,6]; }
code_block_27 = CodeBlock(d=code_block_25, thickness=code_block_26) { d*thickness; }
translate = Geometry.Translate(geometry=pointAtParameter_2, direction=normalAtParameter, distance=code_block_27)
code_block_28 = CodeBlock(neighboroodCenterPoints=translate) { neighboroodCenterPoints; }
pointAtParameter_3 = Curve.PointAtParameter(curve=code_block_21, param=code_block_24.initial)
# note: Original Neighborhood Point (for debugging)
code_block_29 = CodeBlock(originalPoints=pointAtParameter_3) { originalPoints; }

# group: Create Neighborhood Regions
# note: Splits up given input gdRegions into neighborhoods, using input points as centroids. The way this works is that points are fed into a voronoi graph, which is then used to split up gdRegions into actual neighborhood surfaces.
code_block_30 = CodeBlock(gdRegions=code_block_19) { gdRegions; }
byPatch_2 = Surface.ByPatch(closedCurve=code_block_30)
boundingBox = Geometry.BoundingBox(geometry=code_block_30)
code_block_31 = CodeBlock(bb=boundingBox)
# ---------- code_block_31.designscript (5 lines) ----------
p1 = bb.MinPoint;
p2 = bb.MaxPoint;
p3 = Point.ByCoordinates(p1.X, p2.Y);
p4 = Point.ByCoordinates(p2.X, p1.Y);
Rectangle.ByCornerPoints(p1, p3, p2, p4);
# ----------------------------------------
byPatch_3 = Surface.ByPatch(closedCurve=code_block_31.out4)
code_block_32 = CodeBlock(neighboroodCenterPoints=code_block_28) { neighboroodCenterPoints; }
code_block_33 = CodeBlock { 15; }
offset = Curve.Offset(curve=code_block_31.out4, distance=code_block_33)
explode = Geometry.Explode(geometry=offset)
startPoint = Curve.StartPoint(curve=explode)
code_block_34 = CodeBlock(a=code_block_32, b=startPoint)
# ---------- code_block_34.designscript (2 lines) ----------
[List.Flatten([a[0], b[0]], -1),
List.Flatten([a[1], b[1]], -1)];
# ----------------------------------------
UVParameterAtPoint = Surface.UVParameterAtPoint(surface=byPatch_3, point=code_block_34)
byParametersOnSurface = Tessellation.Voronoi.ByParametersOnSurface(uvs=UVParameterAtPoint, face=byPatch_3)
intersect = Geometry.Intersect(geometry=byPatch_2, other=byParametersOnSurface)
flatten = List.Flatten(list=intersect@L3)
extrude_3 = Curve.Extrude(curve=flatten)
byJoinedSurfaces = PolySurface.ByJoinedSurfaces(surfaces=extrude_3)
split = Geometry.Split(geometry=byPatch_2, other=byJoinedSurfaces)
code_block_35 = CodeBlock(a=split) { neighborhoodSurfaces = List.Flatten(a); }
code_block_36 = CodeBlock(voronoiCurves=byParametersOnSurface) { voronoiCurves; }

code_block_37 = CodeBlock(amenityEdgeParams=list_create_10) { amenityEdgeParams; }

# group: Split Neighborhood into Amenity and Desk Areas
# note: Using input parameters pick one of edges of the neighborhood to use as starting point for the amenity. This edge is offset inwards into the neighborhood by a fixed amount, and used to split the surface. Some of the complexity comes from the fact we want to skip short edges, and make sure we offset edges in the right direction.
code_block_38 = CodeBlock(neighborhoodSurfaces=code_block_35) { neighborhoodSurfaces; }
code_block_39 = CodeBlock(neighborhoodSurfaces=code_block_38) { neighborhoodSurfaces; }
perimeterCurves = Surface.PerimeterCurves(surface=code_block_38)
length = Curve.Length(curve=perimeterCurves)
code_block_40 = CodeBlock { minEdgeLen = 10; }
gt = length > code_block_40
filterByBoolMask = List.FilterByBoolMask(list=perimeterCurves, mask=gt)
count = List.Count(list=filterByBoolMask.in@L2)
code_block_41 = CodeBlock(amenityEdgeParams=code_block_37) { amenityEdgeParams; }
code_block_42 = CodeBlock(c=count, params=code_block_41) { Math.Round((c-1) * params); }
getItemAtIndex_5 = List.GetItemAtIndex(list=filterByBoolMask.in@L2, index=code_block_42, lacing=Shortest)
code_block_43 = CodeBlock(pickedEdges=getItemAtIndex_5) { pickedEdges; }
code_block_44 = CodeBlock(t=code_block_43) { midpoint = Curve.PointAtParameter(t, 0.5); tan1 = Curve.NormalAtParameter(t, 0.5); tan2 = Vector.Reverse(tan1); }
list_create_11 = List.Create(item0=code_block_44.tan1, item1=code_block_44.tan2)
transpose = List.Transpose(lists=list_create_11)
normalized = Vector.Normalized(vector=transpose)
code_block_45 = CodeBlock { width = 5; }
translate_2 = Geometry.Translate(geometry=code_block_43, direction=normalized, distance=code_block_45)
doesIntersect = Geometry.DoesIntersect(geometry=code_block_39, other=translate_2)
filterByBoolMask_2 = List.FilterByBoolMask(list=translate_2, mask=doesIntersect)
flatten_2 = List.Flatten(list=filterByBoolMask_2.in)
code_block_46 = CodeBlock { 0.5; }
pointAtParameter_4 = Curve.PointAtParameter(curve=flatten_2, param=code_block_46)
byOriginNormal = Plane.ByOriginNormal(origin=pointAtParameter_4)
code_block_47 = CodeBlock { 4; }
scale = Geometry.Scale(geometry=flatten_2, plane=byOriginNormal, xamount=code_block_47, yamount=code_block_47)
split_2 = Geometry.Split(geometry=code_block_39, other=scale)
code_block_48 = CodeBlock(pickedEdges=code_block_43) { pickedEdges; }
doesIntersect_2 = Geometry.DoesIntersect(geometry=code_block_48, other=split_2)
filterByBoolMask_3 = List.FilterByBoolMask(list=split_2, mask=doesIntersect_2)
flatten_3 = List.Flatten(list=filterByBoolMask_3.in)
intersect_2 = Geometry.Intersect(geometry=flatten_3, other=scale)
isEmpty = List.IsEmpty(list=intersect_2@L2)
filterByBoolMask_4 = List.FilterByBoolMask(list=flatten_3, mask=isEmpty)
code_block_49 = CodeBlock(amenityAreas=filterByBoolMask_4.out) { amenityAreas; }
flatten_4 = List.Flatten(list=intersect_2)
code_block_50 = CodeBlock(splitEdge=flatten_4) { splitEdge; }
flatten_5 = List.Flatten(list=filterByBoolMask_3.out)
code_block_51 = CodeBlock(deskAreas=flatten_5) { deskAreas; }

# group: Create Amenity Spaces
code_block_52 = CodeBlock(amenityAreas=code_block_49) { amenityAreas; }
perimeterCurves_2 = Surface.PerimeterCurves(surface=code_block_52)
byJoinedCurves_2 = PolyCurve.ByJoinedCurves(curves=perimeterCurves_2)
code_block_53 = CodeBlock { -1.2; }
offset_2 = Curve.Offset(curve=byJoinedCurves_2, distance=code_block_53)
code_block_54 = CodeBlock(amenityCurves=offset_2) { amenityCurves; }
explode_2 = Geometry.Explode(geometry=code_block_54)
# note: Amenity areas are created by taking a surface, offsetting in inwards by a fixed amount (so that people can walk around/past it) and creating a door opening. Right now the doors are always in the middle of the original edge that was used to split the neighborhood.
code_block_55 = CodeBlock(splitEdge=code_block_50) { splitEdge; }
pickEdgeClosestToLine = Python(IN[0]=explode_2, IN[1]=code_block_55)  # CPython3
# ---------- pickEdgeClosestToLine.python (23 lines) ----------
# Load the Python Standard and DesignScript Libraries
import sys
import clr
clr.AddReference('ProtoGeometry')
from Autodesk.DesignScript.Geometry import *

# The inputs to this node will be stored as a list in the IN variables.
edges = IN[0]
guideEdge = IN[1]

pickedEdges = []
otherEdges = []

for idx, eList in enumerate(edges):
        otherEdges.append([])
        cp = [Curve.PointAtParameter(x, 0.5) for x in eList]
        edgeL = list(zip(eList, cp))
        edgeL.sort(key = lambda x: Geometry.DistanceTo( Curve.PointAtParameter(guideEdge[idx], 0.5), x[1]))
        pickedEdges.append(edgeL[0][0])
        for k in range(1, len(edgeL)):
                otherEdges[idx].append(edgeL[k][0])
# Assign your output to the OUT variable.
OUT = [pickedEdges, otherEdges]
# ----------------------------------------
code_block_56 = CodeBlock(a=pickEdgeClosestToLine) { a[0]; a[1]; }
code_block_57 = CodeBlock(edgeWithDoor=code_block_56.out0) { edgeWithDoor; }
code_block_58 = CodeBlock { [0.4, 0.6]; }
splitByParameter = Curve.SplitByParameter(curve=code_block_57, parameters=code_block_58)
code_block_59 = CodeBlock { 1; }
removeItemAtIndex = List.RemoveItemAtIndex(list=splitByParameter@L2, indices=code_block_59)
code_block_60 = CodeBlock(otherEdges=code_block_56.out1) { otherEdges; }
list_create_12 = List.Create(item0=removeItemAtIndex, item1=code_block_60)
transpose_2 = List.Transpose(lists=list_create_12)
code_block_61 = CodeBlock(roomWalls=transpose_2) { roomWalls; }
byPatch_4 = Surface.ByPatch(closedCurve=offset_2)
code_block_62 = CodeBlock(amenitySpaces=byPatch_4) { amenitySpaces; }
code_block_63 = CodeBlock { 0.5; }
pointAtParameter_5 = Surface.PointAtParameter(surface=byPatch_4, u=code_block_63, v=code_block_63)
code_block_64 = CodeBlock(roomCenter=pointAtParameter_5) { roomCenter; }
code_block_65 = CodeBlock(amenityCurves=code_block_54) { amenityCurves; }

# group: Step 7 (Amenity Areas)
code_block_66 = CodeBlock { 2; }
extrude_4 = Curve.Extrude(curve=code_block_61, distance=code_block_66)
color_palette = ColorPalette({R: 100, G: 149, B: 237, A: 196})
byGeometryColor = Modifiers.GeometryColor.ByGeometryColor(geometry=extrude_4, color=color_palette)
code_block_67 = CodeBlock(amenityCurves=code_block_65) { amenityCurves; }
color_palette_2 = ColorPalette({R: 0, G: 191, B: 255, A: 255})
byGeometryColor_2 = Modifiers.GeometryColor.ByGeometryColor(geometry=code_block_62, color=color_palette_2)

# group: Step 2 (Neighborhood Spines)
color_palette_3 = ColorPalette({R: 255, G: 127, B: 80, A: 255})
byGeometryColor_3 = Modifiers.GeometryColor.ByGeometryColor(geometry=code_block_20, color=color_palette_3)

# group: Step 0 (Boundary & Windows)
color_palette_4 = ColorPalette({R: 0, G: 191, B: 255, A: 71})
byGeometryColor_4 = Modifiers.GeometryColor.ByGeometryColor(geometry=code_block_7, color=color_palette_4)
color_palette_5 = ColorPalette({R: 0, G: 0, B: 0, A: 255})
byGeometryColor_5 = Modifiers.GeometryColor.ByGeometryColor(geometry=code_block_8, color=color_palette_5)

# group: Create Column System
# note: Manually creating columns.
code_block_68 = CodeBlock()
# ---------- code_block_68.designscript (4 lines) ----------
[6.236,-19.383,15.636,-19.383,25.036,-19.383,34.436,-19.383,6.236,-25.619,15.636,-25.619,25.036,-25.619,34.436,-25.619,6.236,-34.818,15.636,-34.818,25.036,-34.818,34.436,-34.818,6.236,-44.608,15.636,-44.608,25.036,-44.608,34.436,-44.608,6.236,-54.16,6.236,-63.66,6.236,-73.16,6.236,-82.66,6.236,-92.16,6.236,-101.66,15.695,-54.16,15.695,-63.66,15.695,-73.16,15.695,-82.66,15.695,-92.16,15.695,-101.66,34.62,-92.082,34.62,-101.582,25.12,-92.082,25.12,-101.582];
2;
-1;
-2;
# ----------------------------------------
takeEveryNthItem_3 = List.TakeEveryNthItem(list=code_block_68.out0, n=code_block_68.out1, offset=code_block_68.out2)
takeEveryNthItem_4 = List.TakeEveryNthItem(list=code_block_68.out0, n=code_block_68.out1, offset=code_block_68.out3)
byCoordinates_10 = Point.ByCoordinates(x=takeEveryNthItem_3, y=takeEveryNthItem_4)
byOrigin = CoordinateSystem.ByOrigin(origin=byCoordinates_10)
byWidthLength = Rectangle.ByWidthLength(coordinateSystem=byOrigin)
code_block_69 = CodeBlock(columnsAsRect=byWidthLength) { columnsAsRect; }
explode_3 = Geometry.Explode(geometry=byWidthLength)
code_block_70 = CodeBlock { 1; }
approximateCurvesWithLines = Custom[Utils.ApproximateCurvesWithLines](curves=explode_3, segmentLength=code_block_70)  # package SpaceAnalysis; Approximate Curves With Lines
code_block_71 = CodeBlock(columnsAsLines=approximateCurvesWithLines) { columnsAsLines; }

code_block_72 = CodeBlock(columnsAsRect=code_block_69) { columnsAsRect; }

# group: Create Desks
# note: Places desks in double rows, with some hardcoded parameters. Consider columns to avoid collisions when placing desks. Most of the code is in the Python node.
code_block_73 = CodeBlock(deskAreas=code_block_51) { deskAreas; }
perimeterCurves_3 = Surface.PerimeterCurves(surface=code_block_73)
byJoinedCurves_3 = PolyCurve.ByJoinedCurves(curves=perimeterCurves_3)
code_block_74 = CodeBlock { -0.5; }
offset_3 = Curve.Offset(curve=byJoinedCurves_3, distance=code_block_74)
byPatch_5 = Surface.ByPatch(closedCurve=offset_3)
code_block_75 = CodeBlock(shrankedArea=byPatch_5) { shrankedArea; }
code_block_76 = CodeBlock(columns=code_block_72) { columns; }
count_2 = List.Count(list=code_block_75)
ofRepeatedItem = List.OfRepeatedItem(item=code_block_76, amount=count_2)
doesIntersect_3 = Geometry.DoesIntersect(geometry=code_block_75, other=code_block_76, lacing=CrossProduct)
filterByBoolMask_5 = List.FilterByBoolMask(list=ofRepeatedItem, mask=doesIntersect_3)
code_block_77 = CodeBlock(columns=filterByBoolMask_5.in) { columns; }
code_block_78 = CodeBlock { deskWidth = 0.8; deskLenth = 1.8; rowOffset = 2; }
python_script = Python(IN[0]=code_block_75, IN[1]=code_block_77, IN[2]=code_block_78.deskWidth, IN[3]=code_block_78.deskLenth, IN[4]=code_block_78.rowOffset)  # CPython3
# ---------- python_script.python (141 lines) ----------
# Enable Python support and load DesignScript library
import math
import clr

clr.AddReference('ProtoGeometry')
from Autodesk.DesignScript.Geometry import *

def countDeskFunc(k):
    return len(k)

def lenCurveFunc(k):
    return k.Length

def filterEdges(e):
        return e.Length > 1

def scaleLine(line, scale):
        midPoint = line.PointAtParameter(0.5)
        plane = Plane.ByOriginNormal(midPoint, Vector.ByCoordinates(0.0,0.0,1.0))
        ret = Geometry.Scale(line, plane, scale, scale, 1.0)
        midPoint.Dispose()
        plane.Dispose()
        return ret

def placeRowOfDesks(s, edges, offsetEdge, offsetDir, desks, deskPoints, deskDirections, deskWidth, deskLength, rowOffset, columns):
        dCount = 0
        deskCount = offsetEdge.Length / deskLength
        if deskCount >= 2:
                deskPlacements = Curve.PointsAtEqualSegmentLength(offsetEdge, deskCount) #PointsAtEqualSegmentLength PointsAtEqualChordLength
                perpDir = offsetEdge.TangentAtParameter(0.5)
                for deskP in deskPlacements:
                        vec1 = offsetDir.Scale(deskWidth * 0.5)
                        vec2 = vec1.Reverse()
                        vec3 = offsetDir.Scale(deskWidth * 1.5)
                        vec4 = vec3.Reverse()
                        r1 = Point.Add(deskP, vec1)
                        r2 = Point.Add(deskP, vec2)
                        r3 = Point.Add(deskP, vec3)
                        r4 = Point.Add(deskP, vec4)
                        desk = Rectangle.ByWidthLength(CoordinateSystem.ByOriginVectors(r1, offsetDir, perpDir), deskWidth, deskLength)
                        desk2 = Rectangle.ByWidthLength(CoordinateSystem.ByOriginVectors(r2, offsetDir, perpDir), deskWidth, deskLength)
                        intersects1 = False
                        intersects2 = False
                        for col in columns:
                                if Geometry.DoesIntersect(col, desk):
                                        intersects1 = True
                                if Geometry.DoesIntersect(col, desk2):
                                        intersects2 = True
                        for e in edges:
                                if Geometry.DoesIntersect(e, desk):
                                        intersects1 = True
                                if Geometry.DoesIntersect(e, desk2):
                                        intersects2 = True

                        if not intersects1 and Geometry.DoesIntersect(s, desk):
                                desks.append(desk)
                                dCount += 1
                                deskPoints.append(r3)
                                deskDirections.append(Vector.ByTwoPoints(r3, r1))
                        else:
                                desk.Dispose()
                                r3.Dispose()

                        if not intersects2 and Geometry.DoesIntersect(s, desk2):
                                desks.append(desk2)
                                dCount += 1
                                deskPoints.append(r4)
                                deskDirections.append(Vector.ByTwoPoints(r4, r2))
                        else:
                                desk2.Dispose()
                                r4.Dispose()

                        vec1.Dispose()
                        vec2.Dispose()
                        r1.Dispose()
                        r2.Dispose()
                perpDir.Dispose()
        return dCount

# The inputs to this node will be stored as a list in the IN variables.
surfaces = IN[0]
allColumns = IN[1]
deskWidth = IN[2]
deskLength = IN[3]
rowOffset = IN[4]

desks = []
deskPoints = []
deskDirections = []
deskCounts = []
if surfaces and allColumns:
        for i in range(len(surfaces)):
                surface = surfaces[i]
                # figure out direction
                deskCount = 0
                desksGroup = []
                deskPointsGroup = []
                deskDirectionsGroup = []
                edges = surface.PerimeterCurves()
                filteredEdges = list(filter(filterEdges, edges))
                edge = max(filteredEdges, key=lenCurveFunc)
                centerPt = surface.PointAtParameter(0.5, 0.5)
                midpoint = edge.PointAtParameter(0.5)
                offsetDir0 = Vector.ByTwoPoints(midpoint, centerPt);
                offsetDir1 = edge.NormalAtParameter(0.5)
                offsetDir2 = Vector.Reverse(offsetDir1)
                offsetDir = offsetDir1
                if Vector.AngleWithVector(offsetDir0, offsetDir1) > 90:
                        offsetDir = offsetDir2

                j = 0
                while True:
                        offset =  str(j) + ": " + str((rowOffset + deskWidth) + ((rowOffset + (deskWidth*2)) * j))
                        offsetEdge = Geometry.Translate(edge, offsetDir, (rowOffset + deskWidth) + ((rowOffset + (deskWidth*2)) * j))
                        offsetEdge2 = scaleLine(offsetEdge, 20.0)
                        offsetEdge3 = Geometry.Intersect(surface, offsetEdge2)
                        if offsetEdge3:
                                dCount = placeRowOfDesks(surface, edges, offsetEdge3[0], offsetDir, desksGroup, deskPointsGroup, deskDirectionsGroup, deskWidth, deskLength, rowOffset, allColumns[i])
                                deskCount += dCount
                        offsetEdge.Dispose()
                        offsetEdge2.Dispose()
                        for e in offsetEdge3:
                                e.Dispose()

                        if not offsetEdge3:
                                break
                        j += 1
                centerPt.Dispose()
                midpoint.Dispose()
                offsetDir.Dispose()
                offsetDir0.Dispose()
                offsetDir1.Dispose()
                offsetDir2.Dispose()
                #pc.Dispose()
                deskCounts.append(deskCount)
                desks.append(desksGroup)
                deskPoints.append(deskPointsGroup)
                deskDirections.append(deskDirectionsGroup)

# Assign your output to the OUT variable.
OUT = [desks, deskPoints, deskDirections, deskCounts]
# ----------------------------------------
code_block_79 = CodeBlock(a=python_script) { a[0]; a[1]; a[2]; a[3]; }
code_block_80 = CodeBlock(deskCounts=code_block_79.out3) { deskCounts; }
code_block_81 = CodeBlock(deskRects=code_block_79.out0) { deskRects; }
code_block_82 = CodeBlock(deskPts=code_block_79.out1) { deskPts; }
code_block_83 = CodeBlock(deskDirection=code_block_79.out2) { deskDirection; }
area = Surface.Area(surface=code_block_73)
code_block_84 = CodeBlock { 30; }
gt_2 = area > code_block_84
filterByBoolMask_6 = List.FilterByBoolMask(list=code_block_73, mask=gt_2)

# group: Landmarks
# note: Similar to Columns, manually defining landmark locations.
code_block_85 = CodeBlock { [20.342,-69.039,20.758,-53.683,27.862,-53.051,20.342,-69.039]; 2; -1; -2; }
takeEveryNthItem_5 = List.TakeEveryNthItem(list=code_block_85.out0, n=code_block_85.out1, offset=code_block_85.out2)
takeEveryNthItem_6 = List.TakeEveryNthItem(list=code_block_85.out0, n=code_block_85.out1, offset=code_block_85.out3)
byCoordinates_11 = Point.ByCoordinates(x=takeEveryNthItem_5, y=takeEveryNthItem_6)
code_block_86 = CodeBlock(landmarks=byCoordinates_11) { landmarks; }

# group: Geometry System/Analytics Boundary
# note: Freeze this node to disable Analysis & Metrics
code_block_87 = CodeBlock(deskCounts=code_block_80, amenitySpaces=code_block_62, deskRects=code_block_81, boundaryAsLines=code_block_8, columnsAsLines=code_block_71, boundaryAsSuface=code_block_9, floor=code_block_9, landmarks=code_block_86, windowsAsLines=code_block_10)
# ---------- code_block_87.designscript (9 lines) ----------
deskCounts;
amenitySpaces;
deskRects;
boundaryAsLines;
columnsAsLines;
boundaryAsSuface;
floor;
landmarks;
windowsAsLines;
# ----------------------------------------

code_block_88 = CodeBlock(boundaryAsLines=code_block_87.boundaryAsLines) { boundaryAsLines; }
code_block_89 = CodeBlock(deskRects=code_block_87.deskRects) { deskRects; }
parallelize_metrics = BoolSelector(false)
code_block_90 = CodeBlock(columnsAsLines=code_block_87.columnsAsLines) { columnsAsLines; }

# group: Create Path Lattice
# note: SpaceAnalysis package Lattice structure creation. Takes in boundary, walls, desks, to create a lattice that can be used for Pathfinding in the Metrics.
code_block_91 = CodeBlock(boundaryAsLines=code_block_88) { boundaryAsLines; }
code_block_92 = CodeBlock(deskRects=code_block_89) { deskRects; }
approximateCurvesWithLines_2 = Custom[Utils.ApproximateCurvesWithLines](curves=code_block_92)
code_block_93 = CodeBlock(roomWalls=code_block_61) { roomWalls; }
approximateCurvesWithLines_3 = Custom[Utils.ApproximateCurvesWithLines](curves=code_block_93)
join_3 = List.Join(list0=code_block_91, list1=approximateCurvesWithLines_2, list2=approximateCurvesWithLines_3)
byGeometry = BoundingBox.ByGeometry(geom=join_3)
code_block_94 = CodeBlock { 0.4; }
byBoundingBoxAndLines = Core.SpaceLattice.ByBoundingBoxAndLines(boundingBox=byGeometry, barriers=join_3, resolution=code_block_94)
code_block_95 = CodeBlock(pathLattice=byBoundingBoxAndLines) { pathLattice; }
code_block_96 = CodeBlock(columnsAsLines=code_block_90) { columnsAsLines; }

# group: Find Shortest Paths
# note: Find all the shortest paths from desks to landmarks and rooms.
code_block_97 = CodeBlock(pathLattice=code_block_95) { pathLattice; }
code_block_98 = CodeBlock(landmarks=code_block_87.landmarks) { landmarks; }
code_block_99 = CodeBlock(roomCenter=code_block_64) { roomCenter; }
join_4 = List.Join(list0=code_block_98, list1=code_block_99)
closestPointTo = Core.SpaceLattice.ClosestPointTo(spaceLattice=code_block_97, point=join_4)
bySpaceLatticeAndEndPoint = Pathfinding.PathField.BySpaceLatticeAndEndPoint(spaceLattice=code_block_97, endPoint=closestPointTo)
code_block_100 = CodeBlock(deskPositions=code_block_82) { deskPositions; }
closestPointTo_2 = Core.SpaceLattice.ClosestPointTo(spaceLattice=code_block_97, point=code_block_100)
byPathField = Pathfinding.Route.ByPathField(pathField=bySpaceLatticeAndEndPoint, otherPoint=closestPointTo_2, lacing=CrossProduct)
flatten_6 = List.Flatten(list=byPathField)
code_block_101 = CodeBlock { false; }
clean = List.Clean(list=flatten_6, preserveIndices=code_block_101)
count_3 = Pathfinding.Route.Count(route=clean)
code_block_102 = CodeBlock { 0; }
gt_3 = count_3 > code_block_102
filterByBoolMask_7 = List.FilterByBoolMask(list=clean, mask=gt_3)
code_block_103 = CodeBlock(routes=filterByBoolMask_7.in) { routes; }
python_script_2 = Python(IN[0]=count_3)  # CPython3
# ---------- python_script_2.python (19 lines) ----------
# Panalizing desks that are innessesible
import sys
import clr
clr.AddReference('ProtoGeometry')
from Autodesk.DesignScript.Geometry import *

# The inputs to this node will be stored as a list in the IN variables.
counts = IN[0]
outC = []
maxVal  = max(counts)
# Place your code below this line
for c in counts:
        if c == 0:
                outC.append(maxVal)
        else:
                outC.append(c)

# Assign your output to the OUT variable.
OUT = outC
# ----------------------------------------
code_block_104 = CodeBlock(pathApproximateLengths=python_script_2) { pathApproximateLengths; }

# group: Step 9 (Display Path Curves)
code_block_105 = CodeBlock { 3; }
curve = Pathfinding.Route.Curve(route=code_block_103, tidyIterations=code_block_105)

code_block_106 = CodeBlock(pathLattice=code_block_95) { pathLattice; }

# group: Buzz Metric
# note: Congestion map is created by blurring all the input paths. The buzz metric is then calculated by sampling this congestion field and figuring out how spread out the congestion peaks are. While the implementation is slightly different from the original Buzz paper, it is still helpful to refer to the original paper ("The Buzz Metric: A Graph-based Method for Quantifying Productive Congestion in Generative Space Planning for Architecture") for more details and an explanation of the core concept.
code_block_107 = CodeBlock(pathLattice=code_block_106) { pathLattice; }
code_block_108 = CodeBlock(routes=code_block_103) { routes; }
flatten_7 = List.Flatten(list=code_block_108)
code_block_109 = CodeBlock(parallelize=parallelize_metrics) { parallelize; }
parallel_congestion_values = Python(IN[0]=code_block_107, IN[1]=flatten_7, IN[2]=code_block_109)  # CPython3
# ---------- parallel_congestion_values.python (94 lines) ----------
import clr
import math
clr.AddReference('ProtoGeometry')
from Autodesk.DesignScript.Geometry import *
clr.AddReference('DSCoreNodes')
from DSCore import Math
from System.Threading import Monitor

pathLattice = IN[0]
paths = IN[1]
parallel = IN[2]

xCoordinates = pathLattice.XCoordinates()
yCoordinates = pathLattice.YCoordinates()
xCoordinatesLen = len(xCoordinates)
yCoordinatesLen = len(yCoordinates)

rangeMinX = xCoordinates[0]
rangeMaxX = xCoordinates[xCoordinatesLen-1]
rangeMinY = yCoordinates[0]
rangeMaxY = yCoordinates[yCoordinatesLen-1]

r = []

box_kernel = [[1 / 9.0, 1 / 9.0, 1 / 9.0],
              [1 / 9.0, 1 / 9.0, 1 / 9.0],
              [1 / 9.0, 1 / 9.0, 1 / 9.0]]

rhys_kernel = [[1 / 16.0, 1 / 8.0, 1 / 16.0],
              [1 / 8.0, 1 / 4.0, 1 / 8.0],
              [1 / 16.0, 1 / 8.0, 1 / 16.0]]
kernel = rhys_kernel          
              
values = [[0 for i in range(yCoordinatesLen)] for j in range(xCoordinatesLen)]
maxLen = 0;

def initPath(path, values, pathLattice, maxLen):

    if maxLen < path.Count():
        maxLen = path.Count()
    for i in range(path.Count()):
        x_coord = int(math.floor(Math.MapTo(rangeMinX, rangeMaxX, path.XPositionAtIndex(i), 0, xCoordinatesLen-1)))
        y_coord = int(math.floor(Math.MapTo(rangeMinY, rangeMaxY, path.YPositionAtIndex(i), 0, yCoordinatesLen-1)))
        values[x_coord][y_coord] += 1.0

for path in paths:
    initPath(path, values, pathLattice, maxLen)

# Dissipating
iterations = 3
for i in range(iterations):
    for y in range(1, yCoordinatesLen - 1):
        for x in range(1, xCoordinatesLen - 1):        
            acc = 0
            for a in range(-1, 2):
                for b in range(-1, 2):
                    xn = x + a
                    yn = y + b
                    v =  values[xn][yn]
                    acc += v * kernel[a + 1][b + 1]
            values[x][y] = acc


# Route Congestion & Calc Buzz
top = [0 for i in range(len(paths))] 
bottom = [0 for i in range(len(paths))] 

def calculateScore(path, index, top, bottom, pathLattice):

    cong = []
    for i in range(path.Count()):
        x_coord = int(math.floor(Math.MapTo(rangeMinX, rangeMaxX, path.XPositionAtIndex(i), 0, xCoordinatesLen-1)))
        y_coord = int(math.floor(Math.MapTo(rangeMinY, rangeMaxY, path.YPositionAtIndex(i), 0, yCoordinatesLen-1 )))
        cong.append(values[x_coord][y_coord])
    
    if len(cong) > 0:
        h_j = max(cong) - min(cong)
        H_j = 0
        for ji in range(0, len(cong)-1):
            H_j += math.fabs(cong[ji+1] - cong[ji])
        top[index] = path.Count() * H_j
        bottom[index] = path.Count() * h_j

for idx, path in enumerate(paths):
    calculateScore(path, idx, top, bottom, pathLattice)

if sum(bottom) > 0:
    buzz = (sum(top) / sum(bottom)) - 1
else:
    buzz = 0

congestion = values

OUT = [congestion, buzz] 
# ----------------------------------------
code_block_110 = CodeBlock(a=parallel_congestion_values) { a[0]; a[1]; }
code_block_111 = CodeBlock(congestionMap=code_block_110.out0) { congestionMap; }
buzz_max = Watch(code_block_110.out1)  # graph output
code_block_112 = CodeBlock(buzz=code_block_110.out1) { buzz; }

code_block_113 = CodeBlock(amenitySpaces=code_block_87.amenitySpaces) { amenitySpaces; }

# group: Create Visibility Lattice
# note: SpaceAnalysis package Lattice structure creation. Takes in boundary and walls, to create a lattice that can be used for Visibility in the Metrics. The main difference with the Path lattice is that it doesn't use desks as boundaries, and also the resolution can be different.
code_block_114 = CodeBlock(boundaryAsLines=code_block_88) { boundaryAsLines; }
code_block_115 = CodeBlock(columnsAsLines=code_block_90) { columnsAsLines; }
code_block_116 = CodeBlock(amenityArea=code_block_113) { amenityArea; }
perimeterCurves_4 = Surface.PerimeterCurves(surface=code_block_116)
code_block_117 = CodeBlock { 1; }
approximateCurvesWithLines_4 = Custom[Utils.ApproximateCurvesWithLines](curves=perimeterCurves_4, segmentLength=code_block_117)
join_5 = List.Join(list0=code_block_114, list1=code_block_115, list2=approximateCurvesWithLines_4)
byGeometry_2 = BoundingBox.ByGeometry(geom=join_5)
code_block_118 = CodeBlock { 1; }
byBoundingBoxAndLines_2 = Core.SpaceLattice.ByBoundingBoxAndLines(boundingBox=byGeometry_2, barriers=join_5, resolution=code_block_118)
code_block_119 = CodeBlock(visibilityLattice=byBoundingBoxAndLines_2) { visibilityLattice; }

code_block_120 = CodeBlock(boundaryAsSurface=code_block_87.boundaryAsSuface) { boundaryAsSurface; }

# group: Create Window Visibility Grid
# note: Check window visibility using the SpaceAnalysis visibility grid. This creates a union of visibilities from windows (sampled at regular intervals). The visibility grid can then be tested to see if a given location in the office has visibility to at least one of the points.
code_block_121 = CodeBlock(visibilityLattice=code_block_119) { visibilityLattice; }
code_block_122 = CodeBlock(windowSamplePoints=code_block_13) { windowSamplePoints; }
closestPointTo_3 = Core.SpaceLattice.ClosestPointTo(spaceLattice=code_block_121, point=code_block_122)
flatten_8 = List.Flatten(list=closestPointTo_3)
code_block_123 = CodeBlock(boundarySurface=code_block_120) { boundarySurface; }
doesIntersect_4 = Geometry.DoesIntersect(geometry=code_block_123, other=flatten_8)
filterByBoolMask_8 = List.FilterByBoolMask(list=flatten_8, mask=doesIntersect_4)
code_block_124 = CodeBlock(amenitySpaces=code_block_113) { amenitySpaces; }
byJoinedSurfaces_2 = PolySurface.ByJoinedSurfaces(surfaces=code_block_124)
doesIntersect_5 = Geometry.DoesIntersect(geometry=filterByBoolMask_8.in, other=byJoinedSurfaces_2)
filterByBoolMask_9 = List.FilterByBoolMask(list=filterByBoolMask_8.in, mask=doesIntersect_5)
code_block_125 = CodeBlock { distanceThreshold = 40; }
bySpaceLatticeAndViewPoint = Visibility.ViewField.BySpaceLatticeAndViewPoint(spaceLattice=code_block_121, viewPoint=filterByBoolMask_9.out, radius=code_block_125)
byUnion = Visibility.VisibilityGrid.ByUnion(ViewFields=bySpaceLatticeAndViewPoint)
code_block_126 = CodeBlock(visibilityGrid=byUnion) { visibilityGrid; }
code_block_127 = CodeBlock(viewPts=filterByBoolMask_9.out) { viewPts; }

code_block_128 = CodeBlock(visibilityLattice=code_block_119) { visibilityLattice; }
code_block_129 = CodeBlock(deskPts=code_block_82) { deskPts; }
code_block_130 = CodeBlock(deskDirection=code_block_83) { deskDirection; }

# group: Views to Outside Metric
code_block_131 = CodeBlock(visibilityGrid=code_block_126) { visibilityGrid; }
code_block_132 = CodeBlock(routes=code_block_103) { routes; }
points = Pathfinding.Route.Points(route=code_block_132)
flatten_9 = List.Flatten(list=points)
valueAtPoint = Visibility.VisibilityGrid.ValueAtPoint(visibilityGrid=code_block_131, point=flatten_9)
sum = Math.Sum(values=valueAtPoint)
count_4 = List.Count(list=flatten_9)
code_block_133 = CodeBlock(sN=sum, N=count_4) { sN / N; }
code_block_134 = CodeBlock(ViewsToOutsideFromCirculation=code_block_133) { ViewsToOutsideFromCirculation; }
# note: Calculate if there is direct visibility from each desk to the outside.
code_block_135 = CodeBlock(visibilityLattice=code_block_128) { visibilityLattice; }
code_block_136 = CodeBlock(desks=code_block_129) { desks; }
flatten_10 = List.Flatten(list=code_block_136)
code_block_137 = CodeBlock(deskOrientations=code_block_130) { deskOrientations; }
flatten_11 = List.Flatten(list=code_block_137)
code_block_138 = CodeBlock { distanceThreshold = 20; }
code_block_139 = CodeBlock(viewPts=code_block_127) { viewPts; }
code_block_140 = CodeBlock(parallelize=parallelize_metrics) { parallelize; }
python_script_3 = Python(IN[0]=code_block_135, IN[1]=flatten_10, IN[2]=flatten_11, IN[3]=code_block_138, IN[4]=code_block_139, IN[5]=code_block_140)  # CPython3
# ---------- python_script_3.python (55 lines) ----------
import sys
import clr

clr.AddReference('ProtoGeometry')
clr.AddReference('SpaceAnalysis')
from Autodesk.DesignScript.Geometry import *
from System.Threading.Tasks import *
from System.Threading.Tasks import *
from Visibility import *

def Average(lst): 
    return sum(lst) / len(lst) 

visibilityLattice = IN[0]
desks = IN[1]
deskOrientations = IN[2]
distanceThreshold = IN[3]
windowPoints = IN[4]
parallel = IN[5]

resultsCount = [0 for x in range(len(desks))]
resultsDist = [0 for x in range(len(desks))]
resultsPts = [0 for x in range(len(desks))]

def calculateViewsToOutside(point, pt_o, i, visLattice, distanceThreshold, windowPoints, resultsC, resultsD, resultsPts):
	if len(windowPoints) > 0:
		viewField = ViewField.BySpaceLatticeAndViewPoint(visLattice, point, distanceThreshold)
		visGrid = VisibilityGrid.ByViewField(viewField)
		count = 0
		distances = []
		minD = 9999999
		for window in windowPoints:	
			if(visGrid.ValueAtPoint(window) > 0.1):
				vecToPoint = Vector.ByTwoPoints(point, window)
				angle = pt_o.AngleWithVector(vecToPoint)
				if angle <= 110:
					d = Geometry.DistanceTo(point, window)
					if d < minD:
						resultsPts[i] = window
						minD = d
					count += 1.0
					distances.append(d)
		resultsC[i] = count
		if len(distances) > 0:
			resultsC[i] *= (1 / Average(distances))
			resultsD[i] = min(distances)


if parallel:
	Parallel.ForEach(desks, lambda point, state, i: calculateViewsToOutside(point, deskOrientations[i], i, visibilityLattice, distanceThreshold, windowPoints, resultsCount, resultsDist, resultsPts))
else:
	for i, dp in enumerate(desks):
		calculateViewsToOutside(dp, deskOrientations[i], i, visibilityLattice, distanceThreshold, windowPoints, resultsCount, resultsDist, resultsPts)

OUT = [resultsCount, resultsDist, resultsPts]
# ----------------------------------------
code_block_141 = CodeBlock(a=python_script_3) { normDist = a[0]; dists = a[1]; windows = a[2]; }
minimumItem = List.MinimumItem(list=code_block_141.normDist)
maximumItem = List.MaximumItem(list=code_block_141.normDist)
map = Math.Map(rangeMin=minimumItem, rangeMax=maximumItem, inputValue=code_block_141.normDist)
average = Math.Average(numbers=map)
code_block_142 = CodeBlock(ViewsToOutsideFromWorkspaces=average) { ViewsToOutsideFromWorkspaces; }
code_block_143 = CodeBlock(a=code_block_134, b=code_block_142) { (a+b)/2; }
views_to_outside_max = Watch(code_block_143)  # graph output
code_block_144 = CodeBlock(viewsToOutside=code_block_143) { viewsToOutside; }
code_block_145 = CodeBlock(deskPoints=flatten_10) { deskPoints; }
code_block_146 = CodeBlock(windowPts=code_block_141.windows) { windowPts; }
code_block_147 = CodeBlock(rawDists=code_block_141.dists) { rawDists; }
code_block_148 = CodeBlock(viewsToOutsidePerDesk=map) { viewsToOutsidePerDesk; }

# group: Step 4 (Neighborhood Central Points)
color_palette_6 = ColorPalette({R: 255, G: 140, B: 0, A: 255})
byGeometryColor_6 = Modifiers.GeometryColor.ByGeometryColor(geometry=code_block_28, color=color_palette_6)

# group: Team Preferences
# note: These values can be extracted from surveys, for this example we've hardcoded synthetic data that describe team preferences.
code_block_149 = CodeBlock()
# ---------- code_block_149.designscript (6 lines) ----------
// 0 - prefer more distracted area, 1.0 - prefer less distracted area
teamPreferencesDistraction = [0.4,0.7,0.5,0.3,0.1, 0.3, 0.7, 0.1];
// 0 - prefer low light, 1.0 - prefer more light
teamPreferencesLight = [0.3,0.5,0.4,0.6,0.7,0.9,0.8,0.5];
// Number of people in the group
teamSizes = [20, 18, 14, 8, 15, 20, 8, 14];
# ----------------------------------------

code_block_150 = CodeBlock(teamPreferencesLight=code_block_149.teamPreferencesLight) { teamPreferencesLight; }
code_block_151 = CodeBlock(teamPreferencesDistraction=code_block_149.teamPreferencesDistraction) { teamPreferencesDistraction; }
code_block_152 = CodeBlock(teamSizes=code_block_149.teamSizes) { teamSizes; }
code_block_153 = CodeBlock(columnsAsRect=code_block_72) { columnsAsRect; }
code_block_154 = CodeBlock(amenityCurves=code_block_65) { amenityCurves; }
code_block_155 = CodeBlock(amenityCurves=code_block_154) { amenityCurves; }
code_block_156 = CodeBlock(neighborhoodSurfaces=code_block_35) { neighborhoodSurfaces; }

# group: Daylight
code_block_157 = CodeBlock()
# ---------- code_block_157.designscript (3 lines) ----------
// Toronto
lat = 43.67;
long = -79.63;
# ----------------------------------------
code_block_158 = CodeBlock(floor=code_block_87.floor) { floor; }
code_block_159 = CodeBlock { 0.5; }
pointAtParameter_6 = Surface.PointAtParameter(surface=code_block_158, u=code_block_159, v=code_block_159)
byOrigin_2 = CoordinateSystem.ByOrigin(origin=pointAtParameter_6)
byGeometry_3 = BoundingBox.ByGeometry(geom=code_block_158)
code_block_160 = CodeBlock(bb=byGeometry_3)
# ---------- code_block_160.designscript (8 lines) ----------
p1 = bb.MinPoint;
p2 = bb.MaxPoint;
x = p2.X - p1.X;
y = p2.Y - p1.Y;
max = Math.Max(x,y);
p3 = Point.ByCoordinates(p1.X, p2.Y);
p4 = Point.ByCoordinates(p2.X, p1.Y);
Rectangle.ByCornerPoints(p1, p3, p2, p4);
# ----------------------------------------
# note: For some reason we need to create a rectangular grid in order for SolarAnalysis node to work.
byWidthLength_2 = Rectangle.ByWidthLength(coordinateSystem=byOrigin_2, width=code_block_160.max, length=code_block_160.max)
byPatch_6 = Surface.ByPatch(closedCurve=byWidthLength_2)
# note: Uses Solar Analysis package to calculate daylight. The package wraps the former Ecotect engine, and while it is not as callibrated as Radiance, it's still good and is also quite fast. We do an average across a whole year.
code_block_161 = CodeBlock(walls=code_block_16) { walls; }
ZAxis = Vector.ZAxis()
code_block_162 = CodeBlock { 7; }
translate_3 = Geometry.Translate(geometry=code_block_158, direction=ZAxis, distance=code_block_162)
code_block_163 = CodeBlock(ceilings=translate_3) { ceilings; }
code_block_164 = CodeBlock(columns=code_block_153) { columns; }
extrudeAsSolid = Curve.ExtrudeAsSolid(curve=code_block_164, direction=ZAxis, distance=code_block_162)
explode_4 = Geometry.Explode(geometry=extrudeAsSolid)
code_block_165 = CodeBlock(rooms=code_block_155) { rooms; }
extrudeAsSolid_2 = Curve.ExtrudeAsSolid(curve=code_block_165, direction=ZAxis, distance=code_block_162)
explode_5 = Geometry.Explode(geometry=extrudeAsSolid_2)
list_create_13 = List.Create(item0=code_block_161, item1=code_block_158, item2=code_block_163, item3=explode_4, item4=explode_5)
flatten_12 = List.Flatten(list=list_create_13)
date_time = DateTime("2019-03-21T09:00:00Z")
date_time_2 = DateTime("2017-09-21T15:00:00Z")
code_block_166 = CodeBlock()
# ---------- code_block_166.designscript (3 lines) ----------
1;
16.7;
 //Toronto angle;
# ----------------------------------------
code_block_167 = CodeBlock(neighborhoodSurfaces=code_block_156) { neighborhoodSurfaces; }
code_block_168 = CodeBlock(neighborhoodSurfaces=code_block_167) { neighborhoodSurfaces; }
code_block_169 = CodeBlock(floor=code_block_158) { floor; }

byLatitudeLongitude = DynamoSolarAnalysis.Weather.Weather.ByLatitudeLongitude(latitude=code_block_157.lat, longitude=code_block_157.long)
fromSunriseToSunset = DynamoSolarAnalysis.Analysis.TimeStudy.FromSunriseToSunset(startDateTime=date_time, endDateTime=date_time_2)
analyze = DynamoSolarAnalysis.Analysis.SolarAnalysis.Analyze(weather=byLatitudeLongitude, analysisSurfaces=byPatch_6, shadingSurfaces=flatten_12, timeStudy=fromSunriseToSunset, spacing=code_block_166.out0, projectRotation=code_block_166.out1)

# group (continued): Daylight
flatten_13 = List.Flatten(list=analyze.Calculation_Points)
flatten_14 = List.Flatten(list=analyze.Average)
python_script_4 = Python(IN[0]=flatten_13, IN[1]=code_block_168, IN[2]=flatten_14, IN[3]=code_block_169)  # CPython3
# ---------- python_script_4.python (29 lines) ----------
import sys
import clr
clr.AddReference('ProtoGeometry')
from Autodesk.DesignScript.Geometry import *

points = IN[0]
surfaces = IN[1]
values = IN[2]
floor = IN[3]

groupedPoints = [[] for i in range(len(surfaces))]
otherPoints = []

groupedValues = [[] for i in range(len(surfaces))]
otherValues = []

for j,pt in enumerate(points):
        pointAdded = False
        for i, s in enumerate(surfaces):
                if Geometry.DoesIntersect(s, pt):
                        groupedPoints[i].append(pt)
                        groupedValues[i].append(values[j])
                        pointAdded = True
                        break
        if not pointAdded and Geometry.DoesIntersect(floor, pt):
                otherPoints.append(pt)
                otherValues.append(values[j])

OUT = [[otherPoints, groupedPoints],[otherValues,groupedValues]]
# ----------------------------------------
code_block_170 = CodeBlock(x=python_script_4) { pts=x[0]; vals=x[1]; }
code_block_171 = CodeBlock(a=code_block_170.vals) { a[1]; }
code_block_172 = CodeBlock(t3=code_block_171) { t2 = t3 >= 10; t4 = List.CountTrue(t2@L2<1>); t5 = List.Count(t3@L2<1>); t6 = t4 / t5; }
code_block_173 = CodeBlock(neigborhoodDaylight=code_block_172.t6) { neigborhoodDaylight; }
flatten_15 = List.Flatten(list=code_block_170.vals)
code_block_174 = CodeBlock(t3=flatten_15) { t2 = t3 >= 10; t4 = List.CountTrue(t2); t5 = List.Count(t3); t6 = t4 / t5; }
code_block_175 = CodeBlock(daylight=code_block_174.t6) { daylight; }
code_block_176 = CodeBlock(points=code_block_170.pts) { points; }
flatten_16 = List.Flatten(list=code_block_170.vals)
code_block_177 = CodeBlock(values=flatten_16) { values; }
daylight_max = Watch(code_block_174.t6)  # graph output

# group: Visual Distraction Metric
code_block_178 = CodeBlock(visibilityLattice=code_block_128) { visibilityLattice; }
code_block_179 = CodeBlock(congestionMap=code_block_111) { congestionMap; }
code_block_180 = CodeBlock(deskPositions=code_block_129) { deskPositions; }
code_block_181 = CodeBlock(deskOrientations=code_block_130) { deskOrientations; }
closestPointTo_4 = Core.SpaceLattice.ClosestPointTo(spaceLattice=code_block_178, point=code_block_180)
code_block_182 = CodeBlock { 110; 0.4; 0.9; }
# note: Visual distraction is calculated at all the desks, and uses visual distraction from neighbors and highly congested areas.
max_view_radius = CodeBlock { visibilityRadius = 20.0; }
byViewPointAndViewDirection = Visibility.ViewCone.ByViewPointAndViewDirection(viewPoint=closestPointTo_4, viewDirection=code_block_181, angularWidth=code_block_182.out0, radialDepth=max_view_radius, angularSmoothness=code_block_182.out1, radialSmoothness=code_block_182.out2)
bySpaceLatticeAndViewCone = Visibility.ViewField.BySpaceLatticeAndViewCone(spaceLattice=code_block_178, viewCone=byViewPointAndViewDirection, radius=max_view_radius)
byViewField = Visibility.VisibilityGrid.ByViewField(viewField=bySpaceLatticeAndViewCone)
average_2 = Math.Average(numbers=code_block_179)
average_3 = Math.Average(numbers=average_2)
code_block_183 = CodeBlock(a=average_3) { a/2; }
code_block_184 = CodeBlock(parallelize=parallelize_metrics) { parallelize; }
code_block_185 = CodeBlock(spaceLattice=code_block_178, congestionMap=code_block_179, deskPositions=code_block_180, deskOrientation=code_block_181, visibilityGrid=byViewField, congestionThreshold=code_block_183, parallelize=code_block_184) { spaceLattice; congestionMap; deskPositions; deskOrientation; visibilityGrid; congestionThreshold; parallelize; }
congestion_distraction = Python(IN[0]=code_block_185.spaceLattice, IN[1]=code_block_185.congestionMap, IN[2]=code_block_185.deskPositions, IN[3]=code_block_185.deskOrientation, IN[4]=code_block_185.visibilityGrid, IN[5]=code_block_185.congestionThreshold, IN[6]=code_block_185.parallelize)  # CPython3
# ---------- congestion_distraction.python (68 lines) ----------
# This script calculates congestion within a given visible radius.
import clr
import math
clr.AddReference('ProtoGeometry')
from Autodesk.DesignScript.Geometry import *
clr.AddReference('DSCoreNodes')
from DSCore import Math
from System.Threading.Tasks import *

# The inputs to this node will be stored as a list in the IN variables.
spaceLattice = IN[0]
congestionMap = IN[1]
deskPositions = IN[2]
deskOrientations = IN[3]
visibilityGrids = IN[4]
congestionThreshold = IN[5]
parallel = IN[6]

# init results
results = []
for i in range(len(visibilityGrids)):
    results.append([])
    if len(visibilityGrids[i]) > 0:
        for j in range(len(visibilityGrids[i])):
            results[i].append(0)
    else:
        results[i].append(0)

def calculateScore(vGrid, i, nbr, results, spaceLattice, congestionMap, deskPositions, deskOrientations, congestionThreshold):
    xCoordinates = spaceLattice.XCoordinates()
    yCoordinates = spaceLattice.YCoordinates()
    xCoordinatesLen = len(xCoordinates)
    yCoordinatesLen = len(yCoordinates)
    
    rangeMinX = xCoordinates[0]
    rangeMaxX = xCoordinates[xCoordinatesLen-1]
    rangeMinY = yCoordinates[0]
    rangeMaxY = yCoordinates[yCoordinatesLen-1]
    dp_i = deskPositions[nbr][i]
    do_i = deskOrientations[nbr][i]    
    totalPts = 0
    score = 0
    for xCoord in vGrid.XCoordinates():
        for yCoord in vGrid.YCoordinates():
            pt = Point.ByCoordinates(xCoord, yCoord)
            if(vGrid.ValueAtPoint(pt) > 0.1):
                global_x_coord = int(math.floor(Math.MapTo(rangeMinX, rangeMaxX, xCoord, 0, xCoordinatesLen-1)))
                global_y_coord = int(math.floor(Math.MapTo(rangeMinY, rangeMaxY, yCoord, 0, yCoordinatesLen-1)))
                congestion_value = congestionMap[global_x_coord][global_y_coord]
                if congestion_value > congestionThreshold:
                    score += visibilityGrids[nbr][i].ValueAtPoint(pt)
                    totalPts += 1
            pt.Dispose()
    if totalPts > 0:
        results[nbr][i] = score / totalPts;
    else:
        results[nbr][i] = 0
# Assign your output to the OUT variable.

if parallel:
    for nbr in range(len(visibilityGrids)):
        Parallel.ForEach(visibilityGrids[nbr], lambda vGrid, state, i: calculateScore(vGrid, i, nbr, results, spaceLattice, congestionMap, deskPositions, deskOrientations, congestionThreshold))
else:
    for nbr in range(len(visibilityGrids)):
        for idx, vGrid in enumerate(visibilityGrids[nbr]):
            calculateScore(vGrid, idx, nbr, results, spaceLattice, congestionMap, deskPositions, deskOrientations, congestionThreshold)

OUT = results
# ----------------------------------------
average_4 = Math.Average(numbers=congestion_distraction)
code_block_186 = CodeBlock(deskPositions=code_block_180, deskOrientations=code_block_181, visibilityGrid=byViewField, nearbyThreshold=max_view_radius, parallelize=code_block_184) { deskPositions; deskOrientations; visibilityGrid; nearbyThreshold; parallelize; }

neighbor_distraction = Python(IN[0]=code_block_186.deskPositions, IN[1]=code_block_186.deskOrientations, IN[2]=code_block_186.visibilityGrid, IN[3]=code_block_186.nearbyThreshold, IN[4]=code_block_186.parallelize)  # CPython3
# ---------- neighbor_distraction.python (54 lines) ----------
# Enable Python support and load DesignScript library
import clr
clr.AddReference('ProtoGeometry')
from Autodesk.DesignScript.Geometry import *
from System.Threading.Tasks import *
clr.AddReference('DSCoreNodes')
import DSCore
from DSCore import *

# The inputs to this node will be stored as a list in the IN variables.
deskPositions = IN[0]
deskOrientations = IN[1]
visibilityGrids = IN[2]
nearbyThreshold = IN[3]
parallel = IN[4]

deskPositionsFlat = List.Flatten(deskPositions)
deskOrientationsFlat = List.Flatten(deskOrientations)

# init results
results = []
for i in range(len(deskPositions)):
        results.append([])
        if len(visibilityGrids[i]) > 0:
                for j in range(len(visibilityGrids[i])):
                        results[i].append(0)
        else:
                results[i].append(0)

def calculateScore(dp_i, do_i, i, nbr, results, deskPositions, deskOrientations, visibilityGrid, nearbyThreshold):
        score = 0
        totalPts = 0
        for j in range(len(deskPositions)):
                dp_j = deskPositions[j]
                do_j = deskOrientations[j]
                distance = Geometry.DistanceTo(dp_i, dp_j)
                if distance > 0.0001 and distance < nearbyThreshold:
                        totalPts += 1
                        score += visibilityGrid.ValueAtPoint(dp_j);
        if totalPts > 0:
                results[nbr][i] = score / totalPts;
        else:
                results[nbr][i] = 0

if parallel:
        for nbr in range(len(deskPositions)):
                #Parallel.ForEach(deskPositions[nbr], lambda dp, state, i: calculateScore(dp, i, nbr, results, deskPositionsFlat, deskOrientationsFlat, visibilityGrids[nbr][i], nearbyThreshold))
                Parallel.ForEach(deskPositions[nbr], lambda dp, state, i: calculateScore(dp, deskOrientations[nbr][i], i, nbr, results, deskPositionsFlat, deskOrientationsFlat, visibilityGrids[nbr][i], nearbyThreshold))
else:
        for nbr in range(len(deskPositions)):
                for idx, dp in enumerate(deskPositions[nbr]):
                        calculateScore(dp, deskOrientations[nbr][idx], idx, nbr, results, deskPositionsFlat, deskOrientationsFlat, visibilityGrids[nbr][idx], nearbyThreshold)

OUT = results
# ----------------------------------------
average_5 = Math.Average(numbers=neighbor_distraction)

# group (continued): Visual Distraction Metric
code_block_187 = CodeBlock(a=average_4, b=average_5) { (a+b)/2; }
code_block_188 = CodeBlock(perNeiborhoodDistraction=code_block_187) { perNeiborhoodDistraction; }
average_6 = Math.Average(numbers=code_block_187)
distraction_min = Watch(average_6)  # graph output
code_block_189 = CodeBlock(distraction=distraction_min) { distraction; }
code_block_190 = CodeBlock(a=congestion_distraction, b=neighbor_distraction) { (a+b)/2; }
code_block_191 = CodeBlock(distractionPerDesk=code_block_190) { distractionPerDesk; }

code_block_192 = CodeBlock(deskCounts=code_block_87.deskCounts) { deskCounts; }

# group: Team Placement & Work Style Metric
# note: Work Style metric finds how far each neighborhood satisfies teams' lighting and distraction preferences, as well as how well the size of the neighborhood fits the teams. The assignments are assessed using a greedy algorithm that tries to minimize distance.
code_block_193 = CodeBlock(teamPreferencesLight=code_block_150) { teamPreferencesLight; }
code_block_194 = CodeBlock(teamPreferencesDistraction=code_block_151) { teamPreferencesDistraction; }
code_block_195 = CodeBlock { 0.0; }
code_block_196 = CodeBlock(teamSizes=code_block_152) { teamSizes; }
maximumItem_2 = List.MaximumItem(list=code_block_196)
map_2 = Math.Map(rangeMin=code_block_195, rangeMax=maximumItem_2, inputValue=code_block_196)
code_block_197 = CodeBlock(neighborhoodDaylightMetric=code_block_173) { neighborhoodDaylightMetric; }
code_block_198 = CodeBlock(neighborhoodDistractionMetric=code_block_188) { neighborhoodDistractionMetric; }
code_block_199 = CodeBlock(neighborhoodDeskCount=code_block_192) { neighborhoodDeskCount; }
map_3 = Math.Map(rangeMin=code_block_195, rangeMax=maximumItem_2, inputValue=code_block_199)
python_script_5 = Python(IN[0]=code_block_193, IN[1]=code_block_194, IN[2]=map_2, IN[3]=code_block_197, IN[4]=code_block_198, IN[5]=map_3)  # CPython3
# ---------- python_script_5.python (40 lines) ----------
import sys
import clr
import math
clr.AddReference('ProtoGeometry')
from Autodesk.DesignScript.Geometry import *

teamDaylightPreferences = IN[0]
teamDistractionPreferences = IN[1]
teamSizes = IN[2]
neighborhoodDaylightMetric = IN[3]
neighborhoodDistractionMetric = IN[4]
neighborhoodDeskCount = IN[5]

tID = list(range(len(teamSizes)))
teamData = list(zip(tID, teamSizes, teamDaylightPreferences, teamDistractionPreferences))

nID = list(range(len(neighborhoodDeskCount)))
nbrhoodData = list(zip(nID, neighborhoodDeskCount, neighborhoodDaylightMetric, neighborhoodDistractionMetric))

def cost_function(nbr, x):
        d = nbr[1]-x[1]
        # team assignment has higher weight
        return ( 2.0 * (d**2) + 0.5* (nbr[2]-x[2])**2 + 0.5 *(nbr[3]-x[3])**2)

assignedTeamIDs = []
assignedCosts = []

for i,nbr in enumerate(nbrhoodData):
        costs = [cost_function(nbr, x) for x in teamData]
        #unzip data to add costs to list
        tD = list(zip(*teamData))
        tData = list(zip(costs, tD[0], tD[1], tD[2], tD[3]))
        tData.sort(key=lambda x: x[0], reverse=False)
        assignedTeamIDs.append(tData[0][1])
        assignedCosts.append(tData[0][0])
        # remove team that with current id
        id = [c[0] == tData[0][1] for c in teamData].index(True)
        del teamData[id]

OUT = [assignedTeamIDs, assignedCosts]
# ----------------------------------------
code_block_200 = CodeBlock(a=python_script_5) { a[0]; a[1]; }
code_block_201 = CodeBlock(a=code_block_200.out1) { 1 - a; }
average_7 = Math.Average(numbers=code_block_201)
work_style = Watch(average_7)  # graph output
code_block_202 = CodeBlock(assignments=code_block_200.out0) { assignments; }
code_block_203 = CodeBlock(workStyle=average_7) { workStyle; }
code_block_204 = CodeBlock(workStylePerTeam=code_block_201) { workStylePerTeam; }

# group: Adjacency Metric
# note: Simply an average of all the paths. Could be more complicated, but we decided to keep it simple.
code_block_205 = CodeBlock(pathLengths=code_block_104) { pathLengths; }
average_8 = Math.Average(numbers=code_block_205)
adjacency_min = Watch(average_8)  # graph output

# group: Combine and Normalize Metrics
code_block_206 = CodeBlock { ["Adjacency", "Buzz", "Distraction", "Views to Outside", "Daylight", "Work Style"]; }
code_block_207 = CodeBlock(metricNames=code_block_206) { metricNames; }
code_block_208 = CodeBlock(adjacency=adjacency_min) { adjacency; }
code_block_209 = CodeBlock(buzz=code_block_112) { buzz; }
code_block_210 = CodeBlock(distraction=code_block_189) { distraction; }
code_block_211 = CodeBlock(viewsToOutside=code_block_144) { viewsToOutside; }
code_block_212 = CodeBlock(daylight=code_block_175) { daylight; }
code_block_213 = CodeBlock(workStyle=code_block_203) { workStyle; }
list_create_14 = List.Create(item0=code_block_208, item1=code_block_209, item2=code_block_210, item3=code_block_211, item4=code_block_212, item5=code_block_213)
code_block_214 = CodeBlock(combinedMetrics=list_create_14) { combinedMetrics; }
# note: Min and max values for each metric. Reverse the min and the max if the metric is minimized, such as with Adjacency and Distraction.
code_block_215 = CodeBlock { metricMins = [300, 0, 1, 0, 0, 0]; metricMaxs = [0, 10, 0, 1, 1, 1]; }
map_4 = Math.Map(rangeMin=code_block_215.metricMins, rangeMax=code_block_215.metricMaxs, inputValue=list_create_14)
code_block_216 = CodeBlock(normalizedMetrics=map_4) { normalizedMetrics; }

# group: Display Metrics as Text
code_block_217 = CodeBlock(names=code_block_207) { names; }
count_5 = List.Count(list=code_block_217)
code_block_218 = CodeBlock(count=count_5) { 1..count; }
string_from_object = FromObject(obj=code_block_218)
code_block_219 = CodeBlock(values=code_block_214) { values; }
string_from_object_2 = FromObject(obj=code_block_219)
code_block_220 = CodeBlock { x = -30; y = -50; height = 3; }
code_block_221 = CodeBlock(index=string_from_object, name=code_block_217, value=string_from_object_2, offset=code_block_220.x, start=code_block_220.y, height=code_block_220.height, i=code_block_218) { index + ". " + name + ": " + value; Point.ByCoordinates(offset, start - (height * (i - 1))); }
code_block_222 = CodeBlock { 2; }
fromStringOriginAndScale = DynamoText.Text.FromStringOriginAndScale(text=code_block_221.out0, origin=code_block_221.out1, scale=code_block_222)
code_block_223 = CodeBlock(metricsText=fromStringOriginAndScale) { metricsText; }

# group: Display Radar Graph
x_offset = DoubleSlider(11.5, range=0..50 step 0.1)
add = code_block_220.x + x_offset
y_offset = DoubleSlider(29.4, range=0..50 step 0.1)
sub = code_block_220.y - y_offset
byCoordinates_12 = Point.ByCoordinates(x=add, y=sub)
code_block_224 = CodeBlock(position=byCoordinates_12) { position; }
size = DoubleSlider(10.6, range=1..20 step 0.1)
code_block_225 = CodeBlock { bands = 4; }
code_block_226 = CodeBlock(size=size, bands=code_block_225) { 0..size..#bands+2; }
restOfItems = List.RestOfItems(list=code_block_226)
byCenterPointRadius = Circle.ByCenterPointRadius(centerPoint=code_block_224, radius=restOfItems, lacing=Longest)
code_block_227 = CodeBlock(normalizedMetrics=code_block_216) { normalizedMetrics; }
count_6 = List.Count(list=code_block_227)
regularPolygon = Polygon.RegularPolygon(circle=byCenterPointRadius, numberSides=count_6)
ZAxis_2 = Vector.ZAxis()
code_block_228 = CodeBlock { 90; }
rotate = Geometry.Rotate(geometry=regularPolygon, origin=code_block_224, axis=ZAxis_2, degrees=code_block_228)
reverse = List.Reverse(list=rotate)
restOfItems_2 = List.RestOfItems(list=reverse)
firstItem_2 = List.FirstItem(list=restOfItems_2)
code_block_229 = CodeBlock(outerPolygon=firstItem_2) { outerPolygon; }
points_2 = Polygon.Points(polygon=firstItem_2)
byStartPointEndPoint_3 = Line.ByStartPointEndPoint(startPoint=code_block_224, endPoint=points_2)
restOfItems_3 = List.RestOfItems(list=restOfItems_2)
join_6 = List.Join(list0=byStartPointEndPoint_3, list1=restOfItems_3)
color_palette_7 = ColorPalette({R: 192, G: 192, B: 192, A: 255})
byGeometryColor_7 = Modifiers.GeometryColor.ByGeometryColor(geometry=join_6, color=color_palette_7)
code_block_230 = CodeBlock(innerPolygonsAndRadialLines=byGeometryColor_7) { innerPolygonsAndRadialLines; }
pointAtParameter_7 = Curve.PointAtParameter(curve=byStartPointEndPoint_3, param=code_block_227)
byPoints_4 = Polygon.ByPoints(points=pointAtParameter_7)
byPatch_7 = Surface.ByPatch(closedCurve=byPoints_4)
color_palette_8 = ColorPalette({R: 58, G: 215, B: 247, A: 142})
byGeometryColor_8 = Modifiers.GeometryColor.ByGeometryColor(geometry=byPatch_7, color=color_palette_8)
code_block_231 = CodeBlock(radarChartFill=byGeometryColor_8) { radarChartFill; }
color_palette_9 = ColorPalette({R: 58, G: 215, B: 247, A: 190})
byGeometryColor_9 = Modifiers.GeometryColor.ByGeometryColor(geometry=byPoints_4, color=color_palette_9)
code_block_232 = CodeBlock(radarChartOutline=byGeometryColor_9) { radarChartOutline; }
code_block_233 = CodeBlock(count=count_6) { 1..count; }
string_from_object_3 = FromObject(obj=code_block_233)
lastItem = List.LastItem(list=rotate)
points_3 = Polygon.Points(polygon=lastItem)
code_block_234 = CodeBlock { 1.8; }
fromStringOriginAndScale_2 = DynamoText.Text.FromStringOriginAndScale(text=string_from_object_3, origin=points_3, scale=code_block_234)
byGeometry_4 = BoundingBox.ByGeometry(geom=fromStringOriginAndScale_2)
maxPoint = BoundingBox.MaxPoint(boundingBox=byGeometry_4)
minPoint = BoundingBox.MinPoint(boundingBox=byGeometry_4)
asVector = Point.AsVector(point=minPoint)
subtract = Point.Subtract(point=maxPoint, vectorToSubtract=asVector)
X = Point.X(point=subtract)
code_block_235 = CodeBlock { -2; }
div = X / code_block_235
Y = Point.Y(point=subtract)
div_2 = Y / code_block_235
translate_4 = Geometry.Translate(geometry=fromStringOriginAndScale_2, xTranslation=div, yTranslation=div_2)
code_block_236 = CodeBlock(numberText=translate_4) { numberText; }
code_block_237 = CodeBlock(outerPolygonPoints=points_3) { outerPolygonPoints; }

legend = List.Create(item0=code_block_223, item1=code_block_229, item2=code_block_230, item3=code_block_231, item4=code_block_232, item5=code_block_236)
code_block_238 = CodeBlock { ["Distraction", "Adjacency/Buzz (Congestion Map)", "Daylight", "Views to Outside", "Work Style"]; }

# group: Display Labels
code_block_239 = CodeBlock(names=code_block_238) { names; }
code_block_240 = CodeBlock { x = 20; y = -18; width = 40; }
count_7 = List.Count(list=code_block_239)
code_block_241 = CodeBlock(count=count_7) { 1..count; }
code_block_242 = CodeBlock(offset=code_block_240.x, width=code_block_240.width, i=code_block_241, start=code_block_240.y) { Point.ByCoordinates(offset + (width * (i - 1)), start); }
code_block_243 = CodeBlock { 2; }
fromStringOriginAndScale_3 = DynamoText.Text.FromStringOriginAndScale(text=code_block_239, origin=code_block_242, scale=code_block_243)
byGeometry_5 = BoundingBox.ByGeometry(geom=fromStringOriginAndScale_3)
maxPoint_2 = BoundingBox.MaxPoint(boundingBox=byGeometry_5)
minPoint_2 = BoundingBox.MinPoint(boundingBox=byGeometry_5)
asVector_2 = Point.AsVector(point=minPoint_2)
subtract_2 = Point.Subtract(point=maxPoint_2, vectorToSubtract=asVector_2)
X_2 = Point.X(point=subtract_2)
code_block_244 = CodeBlock { -2; }
div_3 = X_2 / code_block_244
translate_5 = Geometry.Translate(geometry=fromStringOriginAndScale_3, xTranslation=div_3)
code_block_245 = CodeBlock(labels=translate_5) { labels; }

code_block_246 = CodeBlock(pathLattice=code_block_106) { pathLattice; }

# group: Define Visibility/Buzz Colors
code_block_247 = CodeBlock()
# ---------- code_block_247.designscript (9 lines) ----------
DSCore.Color.ByARGB(255,0, 0, 4);
DSCore.Color.ByARGB(255,28, 16, 68);
DSCore.Color.ByARGB(255,79, 18, 123);
DSCore.Color.ByARGB(255,129, 37, 129);
DSCore.Color.ByARGB(255,181, 54, 122);
DSCore.Color.ByARGB(255,229, 89, 100);
DSCore.Color.ByARGB(255,251, 135, 97);
DSCore.Color.ByARGB(255,254, 194, 135);
DSCore.Color.ByARGB(255,251, 253, 191);
# ----------------------------------------
list_create_15 = List.Create(item0=code_block_247.out0, item1=code_block_247.out1, item2=code_block_247.out2, item3=code_block_247.out3, item4=code_block_247.out4, item5=code_block_247.out5, item6=code_block_247.out6, item7=code_block_247.out7, item8=code_block_247.out8)
code_block_248 = CodeBlock(colors=list_create_15) { colors; }

# group: Display Congestion Values
code_block_249 = CodeBlock(congestionMap=code_block_111) { congestionMap; }
code_block_250 = CodeBlock(t2=code_block_249) { t1 = DSCore.List.Flatten(t2, -1); t3 = DSCore.List.MaximumItem(t1); }  # frozen
code_block_251 = CodeBlock(spaceLattice=code_block_246) { spaceLattice; }
surface = Core.SpaceLattice.Surface(spaceLattice=code_block_251)
code_block_252 = CodeBlock { 40; 0; }
translate_6 = Geometry.Translate(geometry=surface, xTranslation=code_block_252.out0, yTranslation=code_block_252.out1, zTranslation=code_block_252.out1)
code_block_253 = CodeBlock(colors=code_block_248) { colors; }
reverse_2 = List.Reverse(list=code_block_253)
code_block_254 = CodeBlock { 0..1..#9; }
code_block_255 = CodeBlock { 0; 20; }
map_5 = Math.Map(rangeMin=code_block_255.out0, rangeMax=code_block_255.out1, inputValue=code_block_249)
color_range = ColorRange(colors=reverse_2, indices=code_block_254, value=map_5)
bySurfaceColors = Modifiers.GeometryColor.BySurfaceColors(surface=translate_6, colors=color_range)
code_block_256 = CodeBlock(congestion=bySurfaceColors) { congestion; }

code_block_257 = CodeBlock(columnsAsRect=code_block_72) { columnsAsRect; }
code_block_258 = CodeBlock(columnsAsRect=code_block_257) { columnsAsRect; }
code_block_259 = CodeBlock(amenitySpaces=code_block_113) { amenitySpaces; }
code_block_260 = CodeBlock(amenitySpaces=code_block_259) { amenitySpaces; }
code_block_261 = CodeBlock(amenitySpaces=code_block_260) { amenitySpaces; }

# group: Define Daylight Colors
code_block_262 = CodeBlock()
# ---------- code_block_262.designscript (11 lines) ----------
DSCore.Color.ByARGB(255,49, 54, 149);
DSCore.Color.ByARGB(255,69, 117, 180);
DSCore.Color.ByARGB(255,116, 173, 209);
DSCore.Color.ByARGB(255,171, 217, 233);
DSCore.Color.ByARGB(255,224, 243, 248);
DSCore.Color.ByARGB(255,255, 255, 191);
DSCore.Color.ByARGB(255,254, 224, 144);
DSCore.Color.ByARGB(255,253, 174, 97);
DSCore.Color.ByARGB(255,244, 109, 67);
DSCore.Color.ByARGB(255,215, 48, 39);
DSCore.Color.ByARGB(255,165, 0, 38);
# ----------------------------------------
list_create_16 = List.Create(item0=code_block_262.out0, item1=code_block_262.out1, item2=code_block_262.out2, item3=code_block_262.out3, item4=code_block_262.out4, item5=code_block_262.out5, item6=code_block_262.out6, item7=code_block_262.out7, item8=code_block_262.out8, item9=code_block_262.out9, item10=code_block_262.out10)
code_block_263 = CodeBlock(colors=list_create_16) { colors; }

# group: Display Daylight Values
code_block_264 = CodeBlock(columnsAsRect=code_block_258) { columnsAsRect; }
byPatch_8 = Surface.ByPatch(closedCurve=code_block_264)
code_block_265 = CodeBlock(amenitySpaces=code_block_261) { amenitySpaces; }
list_create_17 = List.Create(item0=byPatch_8, item1=code_block_265)
code_block_266 = CodeBlock { 80; 0; 0.05; }
translate_7 = Geometry.Translate(geometry=list_create_17, xTranslation=code_block_266.out0, yTranslation=code_block_266.out1, zTranslation=code_block_266.out2)
color_palette_10 = ColorPalette({R: 0, G: 0, B: 0, A: 255})
byGeometryColor_10 = Modifiers.GeometryColor.ByGeometryColor(geometry=translate_7, color=color_palette_10)
code_block_267 = CodeBlock(points=code_block_176) { points; }
code_block_268 = CodeBlock { 1; }
code_block_269 = CodeBlock(colors=code_block_263) { colors; }
code_block_270 = CodeBlock { 0..1..#11; }
code_block_271 = CodeBlock(values=code_block_177) { values; }

flatten_17 = List.Flatten(list=code_block_267)

# group (continued): Display Daylight Values
byOrigin_3 = CoordinateSystem.ByOrigin(origin=flatten_17)
byWidthLength_3 = Rectangle.ByWidthLength(coordinateSystem=byOrigin_3, width=code_block_268, length=code_block_268)
byPatch_9 = Surface.ByPatch(closedCurve=byWidthLength_3)
translate_8 = Geometry.Translate(geometry=byPatch_9, xTranslation=code_block_266.out0, yTranslation=code_block_266.out1, zTranslation=code_block_266.out1)

code_block_272 = CodeBlock { 0; 200; }
map_6 = Math.Map(rangeMin=code_block_272.out0, rangeMax=code_block_272.out1, inputValue=code_block_271)

# group (continued): Display Daylight Values
color_range_2 = ColorRange(colors=code_block_269, indices=code_block_270, value=map_6)
byGeometryColor_11 = Modifiers.GeometryColor.ByGeometryColor(geometry=translate_8, color=color_range_2)
join_7 = List.Join(list0=byGeometryColor_10, list1=byGeometryColor_11)
code_block_273 = CodeBlock(daylight=join_7) { daylight; }

code_block_274 = CodeBlock(windowsAsLines=code_block_87.windowsAsLines) { windowsAsLines; }
code_block_275 = CodeBlock(orientations=code_block_130) { orientations; }

# group: Display Views To Outside
code_block_276 = CodeBlock(columnsAsRect=code_block_258) { columnsAsRect; }
byPatch_10 = Surface.ByPatch(closedCurve=code_block_276)
code_block_277 = CodeBlock(amenitySpaces=code_block_261) { amenitySpaces; }
list_create_18 = List.Create(item0=byPatch_10, item1=code_block_277)
code_block_278 = CodeBlock { 120; 0; }
translate_9 = Geometry.Translate(geometry=list_create_18, xTranslation=code_block_278.out0, yTranslation=code_block_278.out1, zTranslation=code_block_278.out1)
color_palette_11 = ColorPalette({R: 192, G: 192, B: 192, A: 255})
byGeometryColor_12 = Modifiers.GeometryColor.ByGeometryColor(geometry=translate_9, color=color_palette_11)
code_block_279 = CodeBlock(windowsAsLines=code_block_274) { windowsAsLines; }
code_block_280 = CodeBlock(desks=code_block_145) { desks; }
code_block_281 = CodeBlock(windowPts=code_block_146) { windowPts; }
code_block_282 = CodeBlock(a=code_block_281) { a == 0; }
filterByBoolMask_10 = List.FilterByBoolMask(list=code_block_280, mask=code_block_282)
list_create_19 = List.Create(item0=code_block_279, item1=filterByBoolMask_10.out)
translate_10 = Geometry.Translate(geometry=list_create_19, xTranslation=code_block_278.out0, yTranslation=code_block_278.out1, zTranslation=code_block_278.out1)
code_block_283 = CodeBlock(orientations=code_block_275) { orientations; }
flatten_18 = List.Flatten(list=code_block_283)
code_block_284 = CodeBlock(rawDists=code_block_147) { rawDists; }
python_script_6 = Python(IN[0]=code_block_280, IN[1]=flatten_18, IN[2]=code_block_284, IN[3]=code_block_281)  # CPython3
# ---------- python_script_6.python (44 lines) ----------
import sys
import clr
clr.AddReference('ProtoGeometry')
from Autodesk.DesignScript.Geometry import *

# The inputs to this node will be stored as a list in the IN variables.
pts = IN[0]
dirs = IN[1]
dists = IN[2]
windows = IN[2]
curves = []
curves2 = []

for i, pt in enumerate(pts):
        dir = dirs[i]
        v1 = Vector.Rotate(dir, Vector.ZAxis(), -110)
        v2 = Vector.Rotate(dir, Vector.ZAxis(), 110)
        if windows[i] == 0:
                v3 = v1.Scale(0.8)
                v4 = v2.Scale(0.8)
        else:
                v3 = v1.Scale(1.0)
                v4 = v2.Scale(1.0)
        sPt = Point.Add(pt, v3)
        ePt = Point.Add(pt, v4)
        arc = Arc.ByCenterPointStartPointEndPoint(pt, sPt, ePt)
        line1 = Line.ByStartPointEndPoint(sPt, pt)
        line2 = Line.ByStartPointEndPoint(pt, ePt)
        pc = PolyCurve.ByJoinedCurves([line1, line2, arc], 0.001)
        sPt.Dispose()
        ePt.Dispose()
        v1.Dispose()
        v2.Dispose()
        v3.Dispose()
        v4.Dispose()
        line1.Dispose()
        line2.Dispose()
        if windows[i] == 0:
                curves2.append(pc)
        else:
                curves.append(pc)


OUT = [curves, curves2]
# ----------------------------------------
code_block_285 = CodeBlock(a=python_script_6) { a[0]; a[1]; }
byPatch_11 = Surface.ByPatch(closedCurve=code_block_285.out0)
filterByBoolMask_11 = List.FilterByBoolMask(list=code_block_280, mask=code_block_282)
filterByBoolMask_12 = List.FilterByBoolMask(list=code_block_281, mask=code_block_282)
byStartPointEndPoint_4 = Line.ByStartPointEndPoint(startPoint=filterByBoolMask_11.out, endPoint=filterByBoolMask_12.out)
list_create_20 = List.Create(item0=byPatch_11, item1=byStartPointEndPoint_4)
translate_11 = Geometry.Translate(geometry=list_create_20, xTranslation=code_block_278.out0, yTranslation=code_block_278.out1, zTranslation=code_block_278.out1)
code_block_286 = CodeBlock()
# ---------- code_block_286.designscript (3 lines) ----------
[DSCore.Color.ByARGB(55, 255, 0, 0),
DSCore.Color.ByARGB(55, 0, 255, 0)];
[0, 1];
# ----------------------------------------
code_block_287 = CodeBlock(viewsToOutside=code_block_148) { viewsToOutside; }
color_range_3 = ColorRange(colors=code_block_286.out0, indices=code_block_286.out1, value=code_block_287)
filterByBoolMask_13 = List.FilterByBoolMask(list=color_range_3, mask=code_block_282)
list_create_21 = List.Create(item0=filterByBoolMask_13.out, item1=filterByBoolMask_13.out)
byGeometryColor_13 = Modifiers.GeometryColor.ByGeometryColor(geometry=translate_11, color=list_create_21)
translate_12 = Geometry.Translate(geometry=code_block_285.out1, xTranslation=code_block_278.out0, yTranslation=code_block_278.out1, zTranslation=code_block_278.out1)
byGeometryColor_14 = Modifiers.GeometryColor.ByGeometryColor(geometry=translate_12, color=filterByBoolMask_13.in)
join_8 = List.Join(list0=byGeometryColor_12, list1=translate_10, list2=byGeometryColor_13, list3=byGeometryColor_14)
code_block_288 = CodeBlock(viewsToOutside=join_8) { viewsToOutside; }

code_block_289 = CodeBlock(deskPts=code_block_129) { deskPts; }
code_block_290 = CodeBlock(distraction=code_block_191) { distraction; }
code_block_291 = CodeBlock(deskRects=code_block_89) { deskRects; }

# group: Display Distraction
code_block_292 = CodeBlock(desks=code_block_289) { desks; }
code_block_293 = CodeBlock { 0.5; }
byCenterPointRadius_2 = Circle.ByCenterPointRadius(centerPoint=code_block_292, radius=code_block_293)
byPatch_12 = Surface.ByPatch(closedCurve=byCenterPointRadius_2)
code_block_294 = CodeBlock()
# ---------- code_block_294.designscript (3 lines) ----------
[DSCore.Color.ByARGB(255, 0, 255, 0),
 DSCore.Color.ByARGB(255, 255, 0, 0)];
[0, 1];
# ----------------------------------------
code_block_295 = CodeBlock(distraction=code_block_290) { distraction; }
color_range_4 = ColorRange(colors=code_block_294.out0, indices=code_block_294.out1, value=code_block_295)
code_block_296 = CodeBlock(colors=color_range_4) { colors; }
byGeometryColor_15 = Modifiers.GeometryColor.ByGeometryColor(geometry=byPatch_12, color=code_block_296)
code_block_297 = CodeBlock(desks=code_block_291) { desks; }
byPatch_13 = Surface.ByPatch(closedCurve=code_block_297)
byGeometryColor_16 = Modifiers.GeometryColor.ByGeometryColor(geometry=byPatch_13, color=code_block_296)
list_create_22 = List.Create(item0=byGeometryColor_15, item1=byGeometryColor_16)
code_block_298 = CodeBlock(distraction=list_create_22) { distraction; }

code_block_299 = CodeBlock(neighborhoodSurfaces=code_block_156) { neighborhoodSurfaces; }

# group: Display Work Style
code_block_300 = CodeBlock(nbrhoods=code_block_299) { nbrhoods; }
code_block_301 = CodeBlock { 160; 0; }
translate_13 = Geometry.Translate(geometry=code_block_300, xTranslation=code_block_301.out0, yTranslation=code_block_301.out1, zTranslation=code_block_301.out1)
code_block_302 = CodeBlock { ["f03b20", "#ffff11","#2ca25f"]; }
code_block_303 = CodeBlock { 255; }
hex_to_colors = Python(IN[0]=code_block_302, IN[1]=code_block_303)  # CPython3
# ---------- hex_to_colors.python (14 lines) ----------
import sys
import clr
clr.AddReference('ProtoGeometry')
clr.AddReference('DSCoreNodes')
from Autodesk.DesignScript.Geometry import *
import DSCore

hexList = IN[0]
alpha = IN[1]
def HEXToRGB(hex):
        h = hex.lstrip('#')
        rgb = tuple(int(h[i:i+2], 16) for i in (0, 2, 4))
        return DSCore.Color.ByARGB(alpha, rgb[0], rgb[1], rgb[2])
OUT = list(map(HEXToRGB, hexList))
# ----------------------------------------
code_block_304 = CodeBlock { 0..2; }
code_block_305 = CodeBlock(workstyle=code_block_204) { workstyle; }
color_range_5 = ColorRange(colors=hex_to_colors, indices=code_block_304, value=code_block_305)
code_block_306 = CodeBlock(colors=color_range_5) { colors; }
byGeometryColor_17 = Modifiers.GeometryColor.ByGeometryColor(geometry=translate_13, color=code_block_306)
code_block_307 = CodeBlock(windowsAsLines=code_block_274) { windowsAsLines; }
translate_14 = Geometry.Translate(geometry=code_block_307, xTranslation=code_block_301.out0, yTranslation=code_block_301.out1, zTranslation=code_block_301.out1)
join_9 = List.Join(list0=byGeometryColor_17, list1=translate_14)
code_block_308 = CodeBlock(workstyle=join_9) { workstyle; }

# group: Display Landmarks
code_block_309 = CodeBlock { 0.3; }
byCenterPointRadius_3 = Circle.ByCenterPointRadius(centerPoint=code_block_86, radius=code_block_309)
code_block_310 = CodeBlock { 4; }
regularPolygon_2 = Polygon.RegularPolygon(circle=byCenterPointRadius_3, numberSides=code_block_310)
color_palette_12 = ColorPalette({R: 255, G: 0, B: 255, A: 255})
byGeometryColor_18 = Modifiers.GeometryColor.ByGeometryColor(geometry=regularPolygon_2, color=color_palette_12)

code_block_311 = CodeBlock(landmarks=byGeometryColor_18) { landmarks; }
code_block_312 = CodeBlock(landmarks=code_block_311) { landmarks; }

# group: Display Column System
color_palette_13 = ColorPalette({R: 0, G: 0, B: 0, A: 136})
byGeometryColor_19 = Modifiers.GeometryColor.ByGeometryColor(geometry=code_block_69, color=color_palette_13)

code_block_313 = CodeBlock(columns=byGeometryColor_19) { columns; }
code_block_314 = CodeBlock(columns=code_block_313) { columns; }
code_block_315 = CodeBlock(windows=byGeometryColor_5) { windows; }
code_block_316 = CodeBlock(windows=code_block_315) { windows; }
code_block_317 = CodeBlock(amenities=byGeometryColor_2) { amenities; }
code_block_318 = CodeBlock(amenities=code_block_317) { amenities; }

# group: Step 5 (Neighborhood Outlines)
perimeterCurves_5 = Surface.PerimeterCurves(surface=code_block_156)
color_palette_14 = ColorPalette({R: 192, G: 192, B: 192, A: 255})
byGeometryColor_20 = Modifiers.GeometryColor.ByGeometryColor(geometry=perimeterCurves_5, color=color_palette_14)

code_block_319 = CodeBlock(neighborhoods=byGeometryColor_20) { neighborhoods; }
code_block_320 = CodeBlock(neighborhoods=code_block_319) { neighborhoods; }
list_join_reduced = List.Join(list0=code_block_316, list1=code_block_318, list2=code_block_320)
all_metrics = List.Create(item0=legend, item1=code_block_245, item2=code_block_256, item3=code_block_273, item4=code_block_288, item5=code_block_298, item6=code_block_308, item7=code_block_312, item8=code_block_314, item9=list_join_reduced)

# group: Step 7b (Desks)
code_block_321 = CodeBlock(deskRects=code_block_81) { deskRects; }

code_block_322 = CodeBlock(desks=code_block_321) { desks; }
code_block_323 = CodeBlock(desks=code_block_322) { desks; }
join_10 = List.Join(list0=legend, list1=list_join_reduced, list2=code_block_318, list3=code_block_323)

# group: Step 6 (Line used to split Neighborhoods)
color_palette_15 = ColorPalette({R: 255, G: 0, B: 255, A: 255})
byGeometryColor_21 = Modifiers.GeometryColor.ByGeometryColor(geometry=code_block_50, color=color_palette_15)

# group: Step 8a (Path Lattice)
edges = Core.SpaceLattice.Edges(spaceLattice=code_block_95)

# group: Step 1 (GD Regions)
code_block_324 = CodeBlock(gdRegions=code_block_19) { gdRegions; }

# group: Step 3 (Original Neighborhood Points)
code_block_325 = CodeBlock(originalPoints=code_block_29) { originalPoints; }

# group: Step 4b(Voronoi curves)
code_block_326 = CodeBlock(voronoiCurves=code_block_36) { voronoiCurves; }

# group: Step 8b (View Lattice)
edges_2 = Core.SpaceLattice.Edges(spaceLattice=code_block_119)

# group: Step 9b (Union Visibility Grid)
code_block_327 = CodeBlock(visibilityGrid=code_block_126) { visibilityGrid; }
surface_2 = Visibility.VisibilityGrid.Surface(visibilityGrid=code_block_327)
values = Visibility.VisibilityGrid.Values(visibilityGrid=code_block_327)
color_range_6 = ColorRange(value=values)  # unwired: colors, indices
bySurfaceColors_2 = Modifiers.GeometryColor.BySurfaceColors(surface=surface_2, colors=color_range_6)
